# Dynamo graph Canvas3D_Arctic.dyn (Dynamo 4.0.0.0)
# author: PlotterNodes samples
# PlotterNodes sample: Dynamo solids in a Canvas 3D window with Arctic display (sky shadows and ambient occlusion).
# packages: PlotterNodes 0.1.0

# group: 1. 3D scene from Dynamo solids
# Any points, curves, surfaces, solids and meshes work; replace the code block with your own geometry.
code_block = CodeBlock()
# ---------- code_block.designscript (12 lines) ----------
// Base block, 60 x 60 x 20
Cuboid.ByLengths(CoordinateSystem.ByOrigin(0, 0, 10), 60, 60, 20);
// Cylinder standing on the block
Cylinder.ByPointsRadius(Point.ByCoordinates(0, 0, 20), Point.ByCoordinates(0, 0, 75), 15);
// Sphere resting on the ground
Sphere.ByCenterPointRadius(Point.ByCoordinates(46, -40, 12), 12);
// Cone behind
Cone.ByPointsRadius(Point.ByCoordinates(-48, 42, 0), Point.ByCoordinates(-48, 42, 50), 16);
// Block with a spherical cavity: occlusion inside the bowl
Cuboid.ByLengths(CoordinateSystem.ByOrigin(-48, -42, 14), 28, 28, 28).Difference(Sphere.ByCenterPointRadius(Point.ByCoordinates(-48, -42, 30), 17));
// Staircase of boxes: contact shadows at every step
Cuboid.ByLengths(CoordinateSystem.ByOrigin(18 + (0..5) * 8, 48, 2 + (0..5) * 2), 8, 16, 4 + (0..5) * 4);
# ----------------------------------------
list_create = List.Create(item0=code_block.out0, item1=code_block.out1, item2=code_block.out2, item3=code_block.out3, item4=code_block.out4, item5=code_block.out5)

# group: 2. Canvas 3D window
# The window opens maximized on another display. Shaded/Arctic buttons (or the A key) switch the display, F11 is full screen, F zooms to fit.
canvas_3d = Canvas3D(geometry=list_create)
