# Dynamo graph Make2D_Scene.dyn (Dynamo 4.0.0.0)
# author: PlotterNodes samples
# PlotterNodes sample: hidden-line drawings (Make2D) of Dynamo solids, parallel and perspective, exported as AxiDraw SVG.
# packages: PlotterNodes 0.1.0

# group: 1. 3D scene from Dynamo solids
# Any solids, surfaces, meshes and curves work; replace the code block with your own geometry.
code_block = CodeBlock()
# ---------- code_block.designscript (10 lines) ----------
// Base block, 60 x 60 x 20
Cuboid.ByLengths(CoordinateSystem.ByOrigin(0, 0, 10), 60, 60, 20);
// Cylinder standing on the block
Cylinder.ByPointsRadius(Point.ByCoordinates(0, 0, 20), Point.ByCoordinates(0, 0, 75), 15);
// Sphere beside it
Sphere.ByCenterPointRadius(Point.ByCoordinates(42, -38, 12), 12);
// Cone behind
Cone.ByPointsRadius(Point.ByCoordinates(-45, 40, 0), Point.ByCoordinates(-45, 40, 50), 16);
// A free curve: projected and hidden-line tested, but it hides nothing
Line.ByStartPointEndPoint(Point.ByCoordinates(-80, -80, 5), Point.ByCoordinates(80, 80, 5));
# ----------------------------------------
list_create = List.Create(item0=code_block.out0, item1=code_block.out1, item2=code_block.out2, item3=code_block.out3, item4=code_block.out4)

# group: 2. Make2D: parallel and perspective
# ByDirection looks along a vector (plan view is 0,0,-1). ByCamera is a perspective from an eye point towards a target; the field of view clips to a square window.
code_block_2 = CodeBlock()
# ---------- code_block_2.designscript (2 lines) ----------
// Isometric-ish view direction (from the viewer into the scene)
Vector.ByCoordinates(-1, -1, -0.8);
# ----------------------------------------
code_block_3 = CodeBlock()
# ---------- code_block_3.designscript (4 lines) ----------
// meshTolerance
0.1;
// creaseAngle
20;
# ----------------------------------------
byDirection = Plotter.Make2D.ByDirection(geometry=list_create, viewDirection=code_block_2, meshTolerance=code_block_3.out0, creaseAngle=code_block_3.out1)
code_block_4 = CodeBlock()
# ---------- code_block_4.designscript (4 lines) ----------
// Camera eye
Point.ByCoordinates(150, -170, 95);
// Camera target (projects to the drawing centre)
Point.ByCoordinates(0, 0, 25);
# ----------------------------------------
code_block_5 = CodeBlock()
# ---------- code_block_5.designscript (6 lines) ----------
// fieldOfView
40;
// imagePlaneDistance
230;
// meshTolerance
0.1;
# ----------------------------------------
byCamera = Plotter.Make2D.ByCamera(geometry=list_create, eyePoint=code_block_4.out0, targetPoint=code_block_4.out1, fieldOfView=code_block_5.out0, imagePlaneDistance=code_block_5.out1, meshTolerance=code_block_5.out2)
frame = Plotter.Make2D.Frame(make2D=byCamera)

# group: 3. Pens, page and AxiDraw SVG
# Visible and hidden lines go to separate pens. Set the SVG paths, then press Run.
code_block_6 = CodeBlock()
# ---------- code_block_6.designscript (8 lines) ----------
// name
"visible";
// color
"#111111";
// strokeWidth
0.5;
// penNumber
1;
# ----------------------------------------
visibleLines = Plotter.Make2D.VisibleLines(make2D=byDirection)
code_block_7 = CodeBlock()
# ---------- code_block_7.designscript (4 lines) ----------
// dx
148.5;
// dy
105;
# ----------------------------------------
translate = Plotter.Polyline.Translate(polyline=visibleLines, dx=code_block_7.out0, dy=code_block_7.out1)
byGeometry = Plotter.Layer.ByGeometry(name=code_block_6.out0, geometry=translate, color=code_block_6.out1, strokeWidth=code_block_6.out2, penNumber=code_block_6.out3)
code_block_8 = CodeBlock()
# ---------- code_block_8.designscript (8 lines) ----------
// name
"hidden";
// color
"#9ca3af";
// strokeWidth
0.3;
// penNumber
2;
# ----------------------------------------
hiddenLines = Plotter.Make2D.HiddenLines(make2D=byDirection)
code_block_9 = CodeBlock()  # same code as code_block_7
translate_2 = Plotter.Polyline.Translate(polyline=hiddenLines, dx=code_block_9.out0, dy=code_block_9.out1)
byGeometry_2 = Plotter.Layer.ByGeometry(name=code_block_8.out0, geometry=translate_2, color=code_block_8.out1, strokeWidth=code_block_8.out2, penNumber=code_block_8.out3)
list_create_2 = List.Create(item0=byGeometry, item1=byGeometry_2)
code_block_10 = CodeBlock()
# ---------- code_block_10.designscript (4 lines) ----------
// width
297;
// height
210;
# ----------------------------------------
byLayers = Plotter.Drawing.ByLayers(layers=list_create_2, width=code_block_10.out0, height=code_block_10.out1)
optimize = Plotter.Drawing.Optimize(drawing=byLayers)
svg_file_path = StringInput("D:\Drawing\PlotterNodes\output\make2d_iso.svg")
code_block_11 = CodeBlock()
# ---------- code_block_11.designscript (2 lines) ----------
// includePageOutline
true;
# ----------------------------------------
exportSvg = Plotter.Drawing.ExportSvg(drawing=optimize, filePath=svg_file_path, includePageOutline=code_block_11)
statistics = Plotter.Drawing.Statistics(drawing=optimize)
watch = Watch(statistics.pathCount)
code_block_12 = CodeBlock()  # same code as code_block_6
visibleLines_2 = Plotter.Make2D.VisibleLines(make2D=byCamera)
code_block_13 = CodeBlock()  # same code as code_block_7
translate_3 = Plotter.Polyline.Translate(polyline=visibleLines_2, dx=code_block_13.out0, dy=code_block_13.out1)
byGeometry_3 = Plotter.Layer.ByGeometry(name=code_block_12.out0, geometry=translate_3, color=code_block_12.out1, strokeWidth=code_block_12.out2, penNumber=code_block_12.out3)
code_block_14 = CodeBlock()  # same code as code_block_8
hiddenLines_2 = Plotter.Make2D.HiddenLines(make2D=byCamera)
code_block_15 = CodeBlock()  # same code as code_block_7
translate_4 = Plotter.Polyline.Translate(polyline=hiddenLines_2, dx=code_block_15.out0, dy=code_block_15.out1)
byGeometry_4 = Plotter.Layer.ByGeometry(name=code_block_14.out0, geometry=translate_4, color=code_block_14.out1, strokeWidth=code_block_14.out2, penNumber=code_block_14.out3)
code_block_16 = CodeBlock()
# ---------- code_block_16.designscript (8 lines) ----------
// name
"frame";
// color
"#c2410c";
// strokeWidth
0.3;
// penNumber
3;
# ----------------------------------------
code_block_17 = CodeBlock()  # same code as code_block_7
translate_5 = Plotter.Polyline.Translate(polyline=frame, dx=code_block_17.out0, dy=code_block_17.out1)
byGeometry_5 = Plotter.Layer.ByGeometry(name=code_block_16.out0, geometry=translate_5, color=code_block_16.out1, strokeWidth=code_block_16.out2, penNumber=code_block_16.out3)
list_create_3 = List.Create(item0=byGeometry_3, item1=byGeometry_4, item2=byGeometry_5)
code_block_18 = CodeBlock()  # same code as code_block_10
byLayers_2 = Plotter.Drawing.ByLayers(layers=list_create_3, width=code_block_18.out0, height=code_block_18.out1)
optimize_2 = Plotter.Drawing.Optimize(drawing=byLayers_2)
svg_file_path_2 = StringInput("D:\Drawing\PlotterNodes\output\make2d_perspective.svg")
code_block_19 = CodeBlock()  # same code as code_block_11
exportSvg_2 = Plotter.Drawing.ExportSvg(drawing=optimize_2, filePath=svg_file_path_2, includePageOutline=code_block_19)
statistics_2 = Plotter.Drawing.Statistics(drawing=optimize_2)
watch_2 = Watch(statistics_2.pathCount)
