# Dynamo graph Make2D_Verify_ASM.dyn (Dynamo 4.0.0.0)
# author: PlotterNodes samples
# Checks Make2D.ByCamera against ASM ray intersections on a cube with a spherical cavity and captures the ASM mesh for the test suite.
# packages: PlotterNodes 0.1.0

# group: Make2D versus ASM: same solid, same camera
# Green-check: ASM-visible points should lie on Make2D visible lines; ASM-hidden points should not. Run once; the captured case lands in tests/make2d/captured.
make2d_vs_asm = CodeBlock()
# ---------- make2d_vs_asm.designscript (40 lines) ----------
// Inputs: edit these. side and R match the test suite shape (cube 10, sphere radius 6.8).
side = 10;
R = 6.8;
eye = Point.ByCoordinates(28, -38, 22);
target = Point.ByCoordinates(0, 0, 0);
fov = 40;
meshTol = -1;
captureFolder = "D:/Drawing/PlotterNodes/tests/make2d/captured";
// The solid
cube = Cuboid.ByLengths(Point.Origin(), side, side, side);
ball = Sphere.ByCenterPointRadius(Point.Origin(), R);
solid = cube.Difference(ball);
// Ground truth from ASM: sample every B-rep edge and cast a line to the eye
edgeCurves = solid.Edges.CurveGeometry;
samples = edgeCurves.PointsAtEqualChordLength(60);
toEye = Vector.ByTwoPoints(samples, eye).Normalized();
sightLines = Line.ByStartPointEndPoint(samples.Translate(toEye, side * 0.002), eye);
asmHidden = sightLines.DoesIntersect(solid);
// Project the samples the way Make2D.ByCamera does
fwd = Vector.ByTwoPoints(eye, target).Normalized();
rgt = fwd.Cross(Vector.ZAxis()).Normalized();
upv = rgt.Cross(fwd);
dist = eye.DistanceTo(target);
offset = 2 * side;
rel = Vector.ByTwoPoints(eye, samples);
depth = rel.Dot(fwd);
drawn = Point.ByCoordinates(rel.Dot(rgt) * dist / depth + offset, rel.Dot(upv) * dist / depth, 0);
flatPts = List.Flatten(drawn, -1);
flatHidden = List.Flatten(asmHidden, -1);
asmVisiblePoints = List.FilterByBoolMask(flatPts, flatHidden)["out"];
asmHiddenPoints = List.FilterByBoolMask(flatPts, flatHidden)["in"];
// Make2D on the same solid and camera, drawn at the same place (Creases and Silhouettes repeated below)
m = Plotter.Make2D.ByCamera([solid], eye, target, null, fov, 0, meshTol);
diagnostics = m.Diagnostics;
make2dVisible = m.VisibleLines.ToPolyCurve().Translate(offset, 0, 0);
make2dCreases = m.Creases.ToPolyCurve().Translate(offset, -1.6 * side, 0);
make2dSilhouettes = m.Silhouettes.ToPolyCurve().Translate(offset + 1.6 * side, -1.6 * side, 0);
counts = [List.Count(asmVisiblePoints), List.Count(asmHiddenPoints), List.Count(m.Creases), List.Count(m.Silhouettes)];
// Exact engine input written for replay in the test suite (python tests/make2d/replay_capture.py)
captured = m.ExportTestCase(captureFolder, "verify");
# ----------------------------------------
