# Dynamo graph Make2D_kronz.dyn (Dynamo 4.3.0.6534)
# packages: PlotterNodes 0.1.0

code_block = CodeBlock { 2..3.5..#5; -15..-5..#5; -15..10..#5; }
byCoordinates = Point.ByCoordinates(x=code_block.out0, y=code_block.out1, z=code_block.out2)
number_slider = DoubleSlider(2.728, range=0..100 step 0.1)
number_slider_2 = DoubleSlider(10.49, range=0..100 step 0.1)
number_slider_3 = DoubleSlider(-10.808, range=-10.808..100 step 0.1)
code_block_2 = CodeBlock { 1.2; }
code_block_3 = CodeBlock { 100; -5; 5; 3; 5; 7; }
randomList = Math.RandomList(amount=code_block_3.out0, value1=code_block_3.out1, value2=code_block_3.out2, seed=code_block_3.out3)
randomList_2 = Math.RandomList(amount=code_block_3.out0, value1=code_block_3.out1, value2=code_block_3.out2, seed=code_block_3.out4)
randomList_3 = Math.RandomList(amount=code_block_3.out0, value1=code_block_3.out1, value2=code_block_3.out2, seed=code_block_3.out5)
byCoordinates_2 = Point.ByCoordinates(x=randomList, y=randomList_2, z=randomList_3)
code_block_4 = CodeBlock { 0.5..1..#100; }
byCenterPointRadius = Sphere.ByCenterPointRadius(centerPoint=byCoordinates_2, radius=code_block_4)
code_block_5 = CodeBlock { 0.0000000001; 1; }
code_block_6 = CodeBlock { 10; }
code_block_7 = CodeBlock { 8; }
byLengths = Cuboid.ByLengths(width=code_block_7, length=code_block_7, height=code_block_7)
code_block_8 = CodeBlock(n=code_block_7) { n*0.6; }
byCenterPointRadius_2 = Sphere.ByCenterPointRadius(radius=code_block_8)
difference = Solid.Difference(solid=byLengths, other=byCenterPointRadius_2)
byDirection = Plotter.Make2D.ByDirection(geometry=difference)
code_block_9 = CodeBlock { 1; }
number_slider_4 = DoubleSlider(12.9, range=0..20 step 0.1)
code_block_10 = CodeBlock { 0.00000000000000000001; }
code_block_11 = CodeBlock { 15; Vector.ByCoordinates(1,1,1); }
byCenterPointRadiusNormal = Circle.ByCenterPointRadiusNormal(radius=code_block_11.out0, normal=code_block_11.out1)
code_block_12 = CodeBlock { 0.2..0.6..#5; }
pointAtParameter = Curve.PointAtParameter(curve=byCenterPointRadiusNormal, param=code_block_12)
byCoordinates_3 = Point.ByCoordinates()
number_slider_5 = DoubleSlider(3.6, range=0..6 step 0.1)
number_slider_6 = DoubleSlider(73, range=0..100 step 0.1)
byCamera = Plotter.Make2D.ByCamera(geometry=difference, eyePoint=pointAtParameter, targetPoint=byCoordinates_3, imagePlaneDistance=number_slider_5, creaseAngle=number_slider_6)
hiddenLines = Plotter.Make2D.HiddenLines(make2D=byCamera)
toPolyCurve = Plotter.Polyline.ToPolyCurve(polyline=hiddenLines)
silhouettes = Plotter.Make2D.Silhouettes(make2D=byCamera)
toPolyCurve_2 = Plotter.Polyline.ToPolyCurve(polyline=silhouettes)
visibleLines = Plotter.Make2D.VisibleLines(make2D=byCamera)
toPolyCurve_3 = Plotter.Polyline.ToPolyCurve(polyline=visibleLines)
list_create = List.Create(item0=toPolyCurve, item1=toPolyCurve_2, item2=toPolyCurve_3)
transpose = List.Transpose(lists=list_create)
code_block_13 = CodeBlock { 8; }
code_block_14 = CodeBlock { -7..7..#5; }
translate = Geometry.Translate(geometry=transpose, xTranslation=code_block_13, yTranslation=code_block_14)
transpose_2 = List.Transpose(lists=translate)
code_block_15 = CodeBlock(x=transpose_2) { x[0]; x[1]; x[2]; }
color_palette = ColorPalette({R: 0, G: 204, B: 102, A: 255})
byGeometryColor = Modifiers.GeometryColor.ByGeometryColor(geometry=code_block_15.out1, color=color_palette)
color_palette_2 = ColorPalette({R: 190, G: 254, B: 5, A: 255})
byGeometryColor_2 = Modifiers.GeometryColor.ByGeometryColor(geometry=code_block_15.out2, color=color_palette_2)
code_block_16 = CodeBlock {  }
diagnostics = Plotter.Make2D.Diagnostics(make2D=byCamera)
color_palette_3 = ColorPalette({R: 234, G: 233, B: 233, A: 255})
byGeometryColor_3 = Modifiers.GeometryColor.ByGeometryColor(geometry=code_block_15.out0, color=color_palette_3)
code_block_17 = CodeBlock {  }
byLengths_2 = Cuboid.ByLengths(origin=byCoordinates_2, width=code_block_4, length=code_block_4, height=code_block_4)
byUnion = Solid.ByUnion(solids=byLengths_2)
difference_2 = Solid.Difference(solid=difference, other=byUnion)
explode = Geometry.Explode(geometry=difference_2)
color_palette_4 = ColorPalette({R: 255, G: 255, B: 0, A: 255})
color_palette_5 = ColorPalette({R: 0, G: 67, B: 255, A: 255})
list_create_2 = List.Create(item0=color_palette_4, item1=color_palette_5)
code_block_18 = CodeBlock { 0..1; }
area = Surface.Area(surface=explode)
remapRange = Math.RemapRange(numbers=area)
color_range = ColorRange(colors=list_create_2, indices=code_block_18, value=remapRange)
byGeometryColor_4 = Modifiers.GeometryColor.ByGeometryColor(geometry=explode, color=color_range)
canvas_3d = Canvas3D(geometry=byGeometryColor_4)
