# Dynamo graph Make2D_kronz_Booleans.dyn (Dynamo 4.3.0.6534)
# packages: PlotterNodes 0.1.0, Buildz_Plotter 0.2.0

# group: Boolean Sphere and Cube
code_block = CodeBlock { 1.2; }
code_block_2 = CodeBlock { 8; }
byLengths = Cuboid.ByLengths(width=code_block_2, length=code_block_2, height=code_block_2)
code_block_3 = CodeBlock(n=code_block_2) { n*0.6; }
byCenterPointRadius = Sphere.ByCenterPointRadius(radius=code_block_3)
intersect = Geometry.Intersect(geometry=byLengths, other=byCenterPointRadius)
difference = Solid.Difference(solid=byLengths, other=byCenterPointRadius)
difference_2 = Solid.Difference(solid=byCenterPointRadius, other=byLengths)
list_create = List.Create(item0=intersect, item1=difference, item2=difference_2)
integer_slider = IntegerSlider(1, range=0..2 step 1)
code_block_4 = CodeBlock(x=list_create, n=integer_slider) { x[n]; }

edges = Topology.Edges(topology=byLengths)
curveGeometry = Edge.CurveGeometry(edge=edges)
code_block_5 = CodeBlock { 0.2; 1; }
code_block_6 = CodeBlock { true; }
buildPipes = TSpline.TSplineSurface.BuildPipes(curves=curveGeometry, defaultRadius=code_block_5.out0, segmentsCount=code_block_5.out1, inSmoothMode=code_block_6)
code_block_7 = CodeBlock { 15; Vector.ByCoordinates(1,1,1); }
byCenterPointRadiusNormal = Circle.ByCenterPointRadiusNormal(radius=code_block_7.out0, normal=code_block_7.out1)
code_block_8 = CodeBlock { 5; }
code_block_9 = CodeBlock(n=code_block_8) { 0.1..0.9..#n; }
pointAtParameter = Curve.PointAtParameter(curve=byCenterPointRadiusNormal, param=code_block_9)
byCoordinates = Point.ByCoordinates()
number_slider = DoubleSlider(3.6, range=0..6 step 0.1)
code_block_10 = CodeBlock { 0; }
byCamera = Plotter.Make2D.ByCamera(geometry=buildPipes, eyePoint=pointAtParameter, targetPoint=byCoordinates, imagePlaneDistance=number_slider, creaseAngle=code_block_10)
silhouettes = Plotter.Make2D.Silhouettes(make2D=byCamera)
hiddenLines = Plotter.Make2D.HiddenLines(make2D=byCamera)
toPolyCurve = Plotter.Polyline.ToPolyCurve(polyline=hiddenLines)
outline = Plotter.Make2D.Outline(make2D=byCamera)
toPolyCurve_2 = Plotter.Polyline.ToPolyCurve(polyline=outline)
visibleLines = Plotter.Make2D.VisibleLines(make2D=byCamera)
toPolyCurve_3 = Plotter.Polyline.ToPolyCurve(polyline=visibleLines)
list_create_2 = List.Create(item0=toPolyCurve, item1=toPolyCurve_2, item2=toPolyCurve_3)
transpose = List.Transpose(lists=list_create_2)
code_block_11 = CodeBlock { 8; }
code_block_12 = CodeBlock(n=code_block_8) { -(n*1.5)..(n*1.5)..#n; }
translate = Geometry.Translate(geometry=transpose, xTranslation=code_block_11, yTranslation=code_block_12)
transpose_2 = List.Transpose(lists=translate)
code_block_13 = CodeBlock(x=transpose_2) { x[0]; x[1]; x[2]; }
code_block_14 = CodeBlock { 0.001; }
translate_2 = Geometry.Translate(geometry=code_block_13.out1, zTranslation=code_block_14)
color_palette = ColorPalette({R: 255, G: 64, B: 0, A: 255})
byGeometryColor = Modifiers.GeometryColor.ByGeometryColor(geometry=translate_2, color=color_palette)
diagnostics = Plotter.Make2D.Diagnostics(make2D=byCamera)
code_block_15 = CodeBlock { -0.001; }
translate_3 = Geometry.Translate(geometry=code_block_13.out0, zTranslation=code_block_15)
color_palette_2 = ColorPalette({R: 230, G: 230, B: 230, A: 255})
byGeometryColor_2 = Modifiers.GeometryColor.ByGeometryColor(geometry=translate_3, color=color_palette_2)
edges_2 = Topology.Edges(topology=byLengths)
code_block_16 = CodeBlock { 0.75; }
fillet = Solid.Fillet(solid=byLengths, edges=edges_2, radius=code_block_16)

# group: Spikey Ball
explode = Geometry.Explode(geometry=byCenterPointRadius)
code_block_17 = CodeBlock { 0..1..#10; }
pointAtParameter_2 = Surface.PointAtParameter(surface=explode, u=code_block_17, v=code_block_17, lacing=CrossProduct)
code_block_18 = CodeBlock { 1.2; }
scale = Geometry.Scale(geometry=pointAtParameter_2, xamount=code_block_18, yamount=code_block_18, zamount=code_block_18)
code_block_19 = CodeBlock { 0.2; }
byPointsRadii = Cone.ByPointsRadii(endPoint=scale, endRadius=code_block_19)
byUnion = Solid.ByUnion(solids=byPointsRadii)
union = Solid.Union(solid=byCenterPointRadius, solid_2=byUnion)
edges_3 = Topology.Edges(topology=union)
code_block_20 = CodeBlock { 0.1; }
fillet_2 = Solid.Fillet(solid=union, edges=edges_3, radius=code_block_20)

color_palette_3 = ColorPalette({R: 143, G: 143, B: 143, A: 255})
color_palette_4 = ColorPalette({R: 0, G: 0, B: 0, A: 255})
number_slider_2 = DoubleSlider(3.6, range=0..6 step 0.1)
code_block_21 = CodeBlock { 100; }
color_palette_5 = ColorPalette({R: 114, G: 153, B: 5, A: 255})
byGeometryColor_3 = Modifiers.GeometryColor.ByGeometryColor(geometry=code_block_13.out2, color=color_palette_5)
list_create_3 = List.Create(item1=translate_2, item2=byGeometryColor_3)  # unwired: item0
code_block_22 = CodeBlock { 500; }
byGeometry = Mesh.ByGeometry(inputGeometry=buildPipes, maxGridLines=code_block_22)
remesh = Mesh.Remesh(mesh=byGeometry)
remesh_2 = Mesh.Remesh(mesh=remesh)
canvas_3d = Canvas3D(geometry=remesh_2)
canvas_3d_shading = CanvasShadingNode(canvas=canvas_3d)
color_palette_6 = ColorPalette({R: 0, G: 192, B: 255, A: 255})
color_palette_7 = ColorPalette({R: 255, G: 255, B: 0, A: 255})
list_create_4 = List.Create(item0=color_palette_6, item1=color_palette_7)
code_block_23 = CodeBlock { 0..1; }
color_range = ColorRange(colors=list_create_4, indices=code_block_23, value=canvas_3d_shading.shade)
byMeshColors = Modifiers.GeometryColor.ByMeshColors(mesh=canvas_3d_shading.mesh, colors=color_range)
edges_4 = Mesh.Edges(mesh=remesh_2)
code_block_24 = CodeBlock(n=canvas_3d_shading.shade) { 1-n; }
triangles = Mesh.Triangles(mesh=remesh_2)
hatch2026 = Custom[Hatch2026](cellValues=code_block_24, surfaces=triangles)  # package Buildz_Plotter; A renovation of the older hatches
