# Dynamo graph Make2D_kronz_Booleans_hatch.dyn (Dynamo 4.3.0.6534)
# packages: PlotterNodes 0.1.0, Buildz_Plotter 0.2.0

# group: Boolean Sphere and Cube
code_block = CodeBlock { 1.2; }
code_block_2 = CodeBlock { 8; }
byLengths = Cuboid.ByLengths(width=code_block_2, length=code_block_2, height=code_block_2)
code_block_3 = CodeBlock(n=code_block_2) { n*0.6; }
byCenterPointRadius = Sphere.ByCenterPointRadius(radius=code_block_3)
intersect = Geometry.Intersect(geometry=byLengths, other=byCenterPointRadius)
difference = Solid.Difference(solid=byLengths, other=byCenterPointRadius)
difference_2 = Solid.Difference(solid=byCenterPointRadius, other=byLengths)
list_create = List.Create(item0=intersect, item1=difference, item2=difference_2)
integer_slider = IntegerSlider(1, range=0..2 step 1)
code_block_4 = CodeBlock(x=list_create, n=integer_slider) { x[n]; }

file_path = Filename("C:\Users\zach\Downloads\eth-polyhedron-penetration\source\untitled.obj")
importFile = Mesh.ImportFile(fileName=file_path)
code_block_5 = CodeBlock { 10000; }
reduce = Mesh.Reduce(mesh=importFile, triangleCount=code_block_5)
code_block_6 = CodeBlock { 10000; }
scale = Mesh.Scale(mesh=reduce, scaleFactor=code_block_6)
code_block_7 = CodeBlock { 15; Vector.ByCoordinates(1,2,1); }
byCenterPointRadiusNormal = Circle.ByCenterPointRadiusNormal(radius=code_block_7.out0, normal=code_block_7.out1)
code_block_8 = CodeBlock { 10; }
code_block_9 = CodeBlock(n=code_block_8) { 0.4..0.1..#n; }
pointAtParameter = Curve.PointAtParameter(curve=byCenterPointRadiusNormal, param=code_block_9)
byCoordinates = Point.ByCoordinates()
number_slider = DoubleSlider(3.6, range=0..6 step 0.1)
code_block_10 = CodeBlock { 0; }
byCamera = Plotter.Make2D.ByCamera(geometry=scale, eyePoint=pointAtParameter, targetPoint=byCoordinates, imagePlaneDistance=number_slider, creaseAngle=code_block_10)
silhouettes = Plotter.Make2D.Silhouettes(make2D=byCamera)
hiddenLines = Plotter.Make2D.HiddenLines(make2D=byCamera)
toPolyCurve = Plotter.Polyline.ToPolyCurve(polyline=hiddenLines)
outline = Plotter.Make2D.Outline(make2D=byCamera)
toPolyCurve_2 = Plotter.Polyline.ToPolyCurve(polyline=outline)
visibleLines = Plotter.Make2D.VisibleLines(make2D=byCamera)
toPolyCurve_3 = Plotter.Polyline.ToPolyCurve(polyline=visibleLines)
list_create_2 = List.Create(item0=toPolyCurve, item1=toPolyCurve_2, item2=toPolyCurve_3)
transpose = List.Transpose(lists=list_create_2)
code_block_11 = CodeBlock { 8; }
code_block_12 = CodeBlock(n=code_block_8) { -(n*1.5)..(n*1.5)..#n; }
translate = Geometry.Translate(geometry=transpose, xTranslation=code_block_11, yTranslation=code_block_12)
transpose_2 = List.Transpose(lists=translate)
code_block_13 = CodeBlock(x=transpose_2) { x[0]; x[1]; x[2]; }
code_block_14 = CodeBlock { 0.001; }
translate_2 = Geometry.Translate(geometry=code_block_13.out1, zTranslation=code_block_14)
color_palette = ColorPalette({R: 255, G: 64, B: 0, A: 255})
byGeometryColor = Modifiers.GeometryColor.ByGeometryColor(geometry=translate_2, color=color_palette)
diagnostics = Plotter.Make2D.Diagnostics(make2D=byCamera)
code_block_15 = CodeBlock { -0.001; }
translate_3 = Geometry.Translate(geometry=code_block_13.out0, zTranslation=code_block_15)
color_palette_2 = ColorPalette({R: 230, G: 230, B: 230, A: 255})
byGeometryColor_2 = Modifiers.GeometryColor.ByGeometryColor(geometry=translate_3, color=color_palette_2)

# group: Spikey Ball
explode = Geometry.Explode(geometry=byCenterPointRadius)
code_block_16 = CodeBlock { 0..1..#10; }
pointAtParameter_2 = Surface.PointAtParameter(surface=explode, u=code_block_16, v=code_block_16, lacing=CrossProduct)
code_block_17 = CodeBlock { 1.2; }
scale_2 = Geometry.Scale(geometry=pointAtParameter_2, xamount=code_block_17, yamount=code_block_17, zamount=code_block_17)
code_block_18 = CodeBlock { 0.2; }
byPointsRadii = Cone.ByPointsRadii(endPoint=scale_2, endRadius=code_block_18)
byUnion = Solid.ByUnion(solids=byPointsRadii)
union = Solid.Union(solid=byCenterPointRadius, solid_2=byUnion)
edges = Topology.Edges(topology=union)
code_block_19 = CodeBlock { 0.1; }
fillet = Solid.Fillet(solid=union, edges=edges, radius=code_block_19)

edges_2 = Topology.Edges(topology=byLengths)
curveGeometry = Edge.CurveGeometry(edge=edges_2)
code_block_20 = CodeBlock { 0.2; 1; }
code_block_21 = CodeBlock { true; }
buildPipes = TSpline.TSplineSurface.BuildPipes(curves=curveGeometry, defaultRadius=code_block_20.out0, segmentsCount=code_block_20.out1, inSmoothMode=code_block_21)
color_palette_3 = ColorPalette({R: 143, G: 143, B: 143, A: 255})
color_palette_4 = ColorPalette({R: 0, G: 0, B: 0, A: 255})
number_slider_2 = DoubleSlider(3.6, range=0..6 step 0.1)
code_block_22 = CodeBlock { 100; }
color_palette_5 = ColorPalette({R: 114, G: 153, B: 5, A: 255})
byGeometryColor_3 = Modifiers.GeometryColor.ByGeometryColor(geometry=code_block_13.out2, color=color_palette_5)
list_create_3 = List.Create(item1=translate_2, item2=byGeometryColor_3)  # unwired: item0
remesh = Mesh.Remesh(mesh=scale)
remesh_2 = Mesh.Remesh(mesh=remesh)
canvas_3d = Canvas3D(geometry=remesh_2)
canvas_3d_shading = CanvasShadingNode(canvas=canvas_3d)
color_palette_6 = ColorPalette({R: 0, G: 192, B: 255, A: 255})
color_palette_7 = ColorPalette({R: 255, G: 255, B: 0, A: 255})
list_create_4 = List.Create(item0=color_palette_6, item1=color_palette_7)
code_block_23 = CodeBlock { 0..1; }
color_range = ColorRange(colors=list_create_4, indices=code_block_23, value=canvas_3d_shading.shade)
byMeshColors = Modifiers.GeometryColor.ByMeshColors(mesh=canvas_3d_shading.mesh, colors=color_range)
edges_3 = Mesh.Edges(mesh=remesh_2)
edges_4 = Topology.Edges(topology=byLengths)
code_block_24 = CodeBlock { 0.75; }
fillet_2 = Solid.Fillet(solid=byLengths, edges=edges_4, radius=code_block_24)
code_block_25 = CodeBlock { 500; }
byGeometry = Mesh.ByGeometry(inputGeometry=fillet_2, maxGridLines=code_block_25)
triangleCentroids = Mesh.TriangleCentroids(mesh=remesh_2)
triangleNormals = Mesh.TriangleNormals(mesh=remesh_2)
code_block_26 = CodeBlock { 0.3; }
byStartPointDirectionLength = Line.ByStartPointDirectionLength(startPoint=triangleCentroids, direction=triangleNormals, length=code_block_26)
code_block_27 = CodeBlock {  }
byLayers = Plotter.Drawing.ByLayers()  # unwired: layers
code_block_28 = CodeBlock { "1_black"; }
code_block_29 = CodeBlock { 0.5; }
code_block_30 = CodeBlock(n=canvas_3d_shading.shade) { 1-n; }
code_block_31 = CodeBlock { 5; 0; }
triangles = Mesh.Triangles(mesh=remesh_2)
hatch2026 = Custom[Hatch2026](distance=code_block_29, cellValues=code_block_30, MaxSteps=code_block_31.out0, surfaces=triangles)  # package Buildz_Plotter; A renovation of the older hatches
join = List.Join(list0=remesh_2, list1=hatch2026)
byCamera_2 = Plotter.Make2D.ByCamera(geometry=join, eyePoint=pointAtParameter, targetPoint=byCoordinates, imagePlaneDistance=number_slider)
visibleLines_2 = Plotter.Make2D.VisibleLines(make2D=byCamera_2)
translate_4 = Plotter.Polyline.Translate(polyline=visibleLines_2, dx=code_block_11, dy=code_block_12)
byGeometry_2 = Plotter.Layer.ByGeometry(name=code_block_28, geometry=translate_4)
code_block_32 = CodeBlock { 12; 18; "in"; }
byLayers_2 = Plotter.Drawing.ByLayers(layers=byGeometry_2, width=code_block_32.out0, height=code_block_32.out1, units=code_block_32.out2)
string = StringInput("D:\MainData\RoboDraws\20261102_CubeShading\")
toPolyCurve_4 = Plotter.Polyline.ToPolyCurve(polyline=visibleLines_2)
translate_5 = Geometry.Translate(geometry=toPolyCurve_4, xTranslation=code_block_11, yTranslation=code_block_12)
flatten = List.Flatten(list=translate_5)
count = List.Count(list=flatten)
code_block_33 = CodeBlock(path=string, n=count) { path+"Cubes_"+n; }
exportSvg = Plotter.Drawing.ExportSvg(drawing=byLayers_2, filePath=code_block_33)
polylines = Plotter.Layer.Polylines(layer=byGeometry_2)
byCurve = Plotter.Polyline.ByCurve(curve=translate_5)
hatch = Plotter.Shape.Hatch()  # unwired: shape
triangleCount = Mesh.TriangleCount(mesh=importFile)
