# Dynamo graph Numeral_1.dyn (Dynamo 4.0.0.0)
# author: PlotterNodes samples
# PlotterNodes sample: A tall bar framed by a grid of squares with nested rectangles (blue and green).
# packages: PlotterNodes 0.1.0

# group: 1. Numeral 1 from Dynamo curves
# Edit the curves in the first code block; any closed or open curves work.
code_block = CodeBlock()
# ---------- code_block.designscript (2 lines) ----------
// Outline of the 1: a closed PolyCurve rectangle (any closed curves work)
[[PolyCurve.ByPoints([Point.ByCoordinates(129, 30), Point.ByCoordinates(168, 30), Point.ByCoordinates(168, 180), Point.ByCoordinates(129, 180)], true)]];
# ----------------------------------------
byCurves = Plotter.Shape.ByCurves(curves=code_block)
code_block_2 = CodeBlock()
# ---------- code_block_2.designscript (2 lines) ----------
// resolution
0.3;
# ----------------------------------------
union = Plotter.Shape.Union(shapes=byCurves, resolution=code_block_2)
code_block_3 = CodeBlock()
# ---------- code_block_3.designscript (4 lines) ----------
// iterations
2;
// ratio
0.2;
# ----------------------------------------
smooth = Plotter.Shape.Smooth(shape=union, iterations=code_block_3.out0, ratio=code_block_3.out1)
code_block_4 = CodeBlock()
# ---------- code_block_4.designscript (4 lines) ----------
// distance
6;
// resolution
0.3;
# ----------------------------------------
offset = Plotter.Shape.Offset(shape=smooth, distance=code_block_4.out0, resolution=code_block_4.out1)
code_block_5 = CodeBlock()
# ---------- code_block_5.designscript (4 lines) ----------
// distance
2.5;
// resolution
0.3;
# ----------------------------------------
offset_2 = Plotter.Shape.Offset(shape=smooth, distance=code_block_5.out0, resolution=code_block_5.out1)

# group: 2. Background pattern
# Seeds, cell sizes and ring gaps live in the code blocks next to each node.
code_block_6 = CodeBlock()
# ---------- code_block_6.designscript (6 lines) ----------
// width
297;
// height
210;
// margin
8;
# ----------------------------------------
region = Plotter.Page.Region(width=code_block_6.out0, height=code_block_6.out1, margin=code_block_6.out2)
code_block_7 = CodeBlock()
# ---------- code_block_7.designscript (18 lines) ----------
// cellWidth
30;
// cellHeight
26;
// gap
6;
// rings
3;
// ringGap
4.5;
// innerShape
"rectangle";
// jitter
1.2;
// seed
11;
// avoidMargin
0;
# ----------------------------------------
grid = Plotter.Pattern.Grid(region=region, cellWidth=code_block_7.out0, cellHeight=code_block_7.out1, gap=code_block_7.out2, rings=code_block_7.out3, ringGap=code_block_7.out4, innerShape=code_block_7.out5, jitter=code_block_7.out6, seed=code_block_7.out7, avoid=offset, avoidMargin=code_block_7.out8)
code_block_8 = CodeBlock()
# ---------- code_block_8.designscript (4 lines) ----------
// start
0;
// step
2;
# ----------------------------------------
selectRings = Plotter.Pattern.SelectRings(cells=grid, start=code_block_8.out0, step=code_block_8.out1)
code_block_9 = CodeBlock()
# ---------- code_block_9.designscript (8 lines) ----------
// amplitude
0.5;
// wavelength
9;
// seed
1;
// octaves
2;
# ----------------------------------------
wobble = Plotter.Shape.Wobble(shape=selectRings, amplitude=code_block_9.out0, wavelength=code_block_9.out1, seed=code_block_9.out2, octaves=code_block_9.out3)
code_block_10 = CodeBlock()
# ---------- code_block_10.designscript (4 lines) ----------
// keepInside
false;
// resolution
0.3;
# ----------------------------------------
clip = Plotter.Shape.Clip(shape=offset, geometry=wobble, keepInside=code_block_10.out0, resolution=code_block_10.out1)
code_block_11 = CodeBlock()
# ---------- code_block_11.designscript (4 lines) ----------
// start
1;
// step
2;
# ----------------------------------------
selectRings_2 = Plotter.Pattern.SelectRings(cells=grid, start=code_block_11.out0, step=code_block_11.out1)
code_block_12 = CodeBlock()
# ---------- code_block_12.designscript (8 lines) ----------
// amplitude
0.5;
// wavelength
9;
// seed
2;
// octaves
2;
# ----------------------------------------
wobble_2 = Plotter.Shape.Wobble(shape=selectRings_2, amplitude=code_block_12.out0, wavelength=code_block_12.out1, seed=code_block_12.out2, octaves=code_block_12.out3)
code_block_13 = CodeBlock()  # same code as code_block_10
clip_2 = Plotter.Shape.Clip(shape=offset, geometry=wobble_2, keepInside=code_block_13.out0, resolution=code_block_13.out1)

# group: 3. Pens, page and AxiDraw SVG
# One Layer per pen. Set the SVG path, then press Run.
code_block_14 = CodeBlock()
# ---------- code_block_14.designscript (8 lines) ----------
// name
"blue";
// color
"#3fa7e0";
// strokeWidth
0.6;
// penNumber
1;
# ----------------------------------------
byGeometry = Plotter.Layer.ByGeometry(name=code_block_14.out0, geometry=clip, color=code_block_14.out1, strokeWidth=code_block_14.out2, penNumber=code_block_14.out3)
code_block_15 = CodeBlock()
# ---------- code_block_15.designscript (8 lines) ----------
// name
"green";
// color
"#7bb662";
// strokeWidth
0.6;
// penNumber
2;
# ----------------------------------------
byGeometry_2 = Plotter.Layer.ByGeometry(name=code_block_15.out0, geometry=clip_2, color=code_block_15.out1, strokeWidth=code_block_15.out2, penNumber=code_block_15.out3)
code_block_16 = CodeBlock()
# ---------- code_block_16.designscript (8 lines) ----------
// name
"pink";
// color
"#ff6fae";
// strokeWidth
0.6;
// penNumber
3;
# ----------------------------------------
code_block_17 = CodeBlock()
# ---------- code_block_17.designscript (8 lines) ----------
// amplitude
0.4;
// wavelength
14;
// seed
3;
// octaves
2;
# ----------------------------------------
wobble_3 = Plotter.Shape.Wobble(shape=smooth, amplitude=code_block_17.out0, wavelength=code_block_17.out1, seed=code_block_17.out2, octaves=code_block_17.out3)
code_block_18 = CodeBlock()
# ---------- code_block_18.designscript (8 lines) ----------
// amplitude
0.4;
// wavelength
14;
// seed
4;
// octaves
2;
# ----------------------------------------
wobble_4 = Plotter.Shape.Wobble(shape=offset_2, amplitude=code_block_18.out0, wavelength=code_block_18.out1, seed=code_block_18.out2, octaves=code_block_18.out3)
code_block_19 = CodeBlock()
# ---------- code_block_19.designscript (8 lines) ----------
// amplitude
0.5;
// wavelength
16;
// seed
5;
// octaves
2;
# ----------------------------------------
wobble_5 = Plotter.Shape.Wobble(shape=offset, amplitude=code_block_19.out0, wavelength=code_block_19.out1, seed=code_block_19.out2, octaves=code_block_19.out3)
list_create = List.Create(item0=wobble_3, item1=wobble_4, item2=wobble_5)
byGeometry_3 = Plotter.Layer.ByGeometry(name=code_block_16.out0, geometry=list_create, color=code_block_16.out1, strokeWidth=code_block_16.out2, penNumber=code_block_16.out3)
code_block_20 = CodeBlock()
# ---------- code_block_20.designscript (8 lines) ----------
// name
"fill";
// color
"#dde3ff";
// strokeWidth
0.3;
// penNumber
4;
# ----------------------------------------
code_block_21 = CodeBlock()
# ---------- code_block_21.designscript (6 lines) ----------
// spacing
1.8;
// angle
60;
// inset
1.5;
# ----------------------------------------
hatch = Plotter.Shape.Hatch(shape=smooth, spacing=code_block_21.out0, angle=code_block_21.out1, inset=code_block_21.out2)
byGeometry_4 = Plotter.Layer.ByGeometry(name=code_block_20.out0, geometry=hatch, color=code_block_20.out1, strokeWidth=code_block_20.out2, penNumber=code_block_20.out3)
list_create_2 = List.Create(item0=byGeometry, item1=byGeometry_2, item2=byGeometry_3, item3=byGeometry_4)
byLayers = Plotter.Drawing.ByLayers(layers=list_create_2)
optimize = Plotter.Drawing.Optimize(drawing=byLayers)
svg_file_path = StringInput("D:\Drawing\PlotterNodes\output\numeral_1.svg")
code_block_22 = CodeBlock()
# ---------- code_block_22.designscript (2 lines) ----------
// includePageOutline
true;
# ----------------------------------------
exportSvg = Plotter.Drawing.ExportSvg(drawing=optimize, filePath=svg_file_path, includePageOutline=code_block_22)
statistics = Plotter.Drawing.Statistics(drawing=optimize)
watch = Watch(statistics.drawLength)
