# Dynamo graph Numeral_3.dyn (Dynamo 4.0.0.0)
# author: PlotterNodes samples
# PlotterNodes sample: Green and blue bull's-eyes around a 3 wrapped in a scalloped, flower-like halo.
# packages: PlotterNodes 0.1.0

# group: 1. Numeral 3 from Dynamo curves
# Edit the curves in the first code block; any closed or open curves work.
code_block = CodeBlock()
# ---------- code_block.designscript (3 lines) ----------
// Centre lines of the 3: two arcs; thickened to 22 mm below
[Arc.ByThreePoints(Point.ByCoordinates(118.4, 156.5), Point.ByCoordinates(178, 151.3), Point.ByCoordinates(141.3, 107.5)),
 Arc.ByThreePoints(Point.ByCoordinates(141, 108.4), Point.ByCoordinates(183.4, 65.6), Point.ByCoordinates(115, 53.5))];
# ----------------------------------------
byCurve = Plotter.Polyline.ByCurve(curve=code_block)
code_block_2 = CodeBlock()
# ---------- code_block_2.designscript (4 lines) ----------
// resolution
0.3;
// padding
22;
# ----------------------------------------
byPolylines = Plotter.DistanceField.ByPolylines(polylines=byCurve, resolution=code_block_2.out0, padding=code_block_2.out1)
code_block_3 = CodeBlock()
# ---------- code_block_3.designscript (2 lines) ----------
// level
11;
# ----------------------------------------
contour = Plotter.DistanceField.Contour(distanceField=byPolylines, level=code_block_3)
code_block_4 = CodeBlock()
# ---------- code_block_4.designscript (4 lines) ----------
// distance
9;
// resolution
0.3;
# ----------------------------------------
offset = Plotter.Shape.Offset(shape=contour, distance=code_block_4.out0, resolution=code_block_4.out1)
code_block_5 = CodeBlock()
# ---------- code_block_5.designscript (6 lines) ----------
// amplitude
4;
// wavelength
18;
// scallop
true;
# ----------------------------------------
scallop = Plotter.Shape.Scallop(shape=offset, amplitude=code_block_5.out0, wavelength=code_block_5.out1, scallop=code_block_5.out2)

# group: 2. Background pattern
# Seeds, cell sizes and ring gaps live in the code blocks next to each node.
code_block_6 = CodeBlock()
# ---------- code_block_6.designscript (6 lines) ----------
// width
297;
// height
210;
// margin
8;
# ----------------------------------------
region = Plotter.Page.Region(width=code_block_6.out0, height=code_block_6.out1, margin=code_block_6.out2)
code_block_7 = CodeBlock()
# ---------- code_block_7.designscript (16 lines) ----------
// minRadius
6;
// maxRadius
20;
// spacing
3;
// rings
3;
// ringGap
3.5;
// seed
3;
// avoidMargin
3;
// attempts
5000;
# ----------------------------------------
circles = Plotter.Pattern.Circles(region=region, minRadius=code_block_7.out0, maxRadius=code_block_7.out1, spacing=code_block_7.out2, rings=code_block_7.out3, ringGap=code_block_7.out4, seed=code_block_7.out5, avoid=scallop, avoidMargin=code_block_7.out6, attempts=code_block_7.out7)
code_block_8 = CodeBlock()
# ---------- code_block_8.designscript (4 lines) ----------
// start
0;
// step
2;
# ----------------------------------------
selectRings = Plotter.Pattern.SelectRings(cells=circles, start=code_block_8.out0, step=code_block_8.out1)
code_block_9 = CodeBlock()
# ---------- code_block_9.designscript (4 lines) ----------
// start
1;
// step
2;
# ----------------------------------------
selectRings_2 = Plotter.Pattern.SelectRings(cells=circles, start=code_block_9.out0, step=code_block_9.out1)

# group: 3. Pens, page and AxiDraw SVG
# One Layer per pen. Set the SVG path, then press Run.
code_block_10 = CodeBlock()
# ---------- code_block_10.designscript (8 lines) ----------
// name
"green";
// color
"#8bc34a";
// strokeWidth
0.7;
// penNumber
1;
# ----------------------------------------
code_block_11 = CodeBlock()
# ---------- code_block_11.designscript (8 lines) ----------
// amplitude
0.6;
// wavelength
9;
// seed
1;
// octaves
2;
# ----------------------------------------
wobble = Plotter.Shape.Wobble(shape=selectRings, amplitude=code_block_11.out0, wavelength=code_block_11.out1, seed=code_block_11.out2, octaves=code_block_11.out3)
byGeometry = Plotter.Layer.ByGeometry(name=code_block_10.out0, geometry=wobble, color=code_block_10.out1, strokeWidth=code_block_10.out2, penNumber=code_block_10.out3)
code_block_12 = CodeBlock()
# ---------- code_block_12.designscript (8 lines) ----------
// name
"blue";
// color
"#1e88e5";
// strokeWidth
0.7;
// penNumber
2;
# ----------------------------------------
code_block_13 = CodeBlock()
# ---------- code_block_13.designscript (8 lines) ----------
// amplitude
0.5;
// wavelength
8;
// seed
2;
// octaves
2;
# ----------------------------------------
wobble_2 = Plotter.Shape.Wobble(shape=selectRings_2, amplitude=code_block_13.out0, wavelength=code_block_13.out1, seed=code_block_13.out2, octaves=code_block_13.out3)
byGeometry_2 = Plotter.Layer.ByGeometry(name=code_block_12.out0, geometry=wobble_2, color=code_block_12.out1, strokeWidth=code_block_12.out2, penNumber=code_block_12.out3)
code_block_14 = CodeBlock()
# ---------- code_block_14.designscript (8 lines) ----------
// name
"halo";
// color
"#cddc39";
// strokeWidth
0.6;
// penNumber
3;
# ----------------------------------------
code_block_15 = CodeBlock()
# ---------- code_block_15.designscript (8 lines) ----------
// amplitude
0.4;
// wavelength
12;
// seed
3;
// octaves
2;
# ----------------------------------------
wobble_3 = Plotter.Shape.Wobble(shape=scallop, amplitude=code_block_15.out0, wavelength=code_block_15.out1, seed=code_block_15.out2, octaves=code_block_15.out3)
byGeometry_3 = Plotter.Layer.ByGeometry(name=code_block_14.out0, geometry=wobble_3, color=code_block_14.out1, strokeWidth=code_block_14.out2, penNumber=code_block_14.out3)
code_block_16 = CodeBlock()
# ---------- code_block_16.designscript (8 lines) ----------
// name
"numeral";
// color
"#e86fc4";
// strokeWidth
0.6;
// penNumber
4;
# ----------------------------------------
code_block_17 = CodeBlock()
# ---------- code_block_17.designscript (8 lines) ----------
// amplitude
0.5;
// wavelength
14;
// seed
4;
// octaves
2;
# ----------------------------------------
wobble_4 = Plotter.Shape.Wobble(shape=contour, amplitude=code_block_17.out0, wavelength=code_block_17.out1, seed=code_block_17.out2, octaves=code_block_17.out3)
byGeometry_4 = Plotter.Layer.ByGeometry(name=code_block_16.out0, geometry=wobble_4, color=code_block_16.out1, strokeWidth=code_block_16.out2, penNumber=code_block_16.out3)
code_block_18 = CodeBlock()
# ---------- code_block_18.designscript (8 lines) ----------
// name
"fill";
// color
"#ece4ff";
// strokeWidth
0.3;
// penNumber
5;
# ----------------------------------------
code_block_19 = CodeBlock()
# ---------- code_block_19.designscript (6 lines) ----------
// spacing
1.8;
// angle
60;
// inset
1.5;
# ----------------------------------------
hatch = Plotter.Shape.Hatch(shape=contour, spacing=code_block_19.out0, angle=code_block_19.out1, inset=code_block_19.out2)
byGeometry_5 = Plotter.Layer.ByGeometry(name=code_block_18.out0, geometry=hatch, color=code_block_18.out1, strokeWidth=code_block_18.out2, penNumber=code_block_18.out3)
list_create = List.Create(item0=byGeometry, item1=byGeometry_2, item2=byGeometry_3, item3=byGeometry_4, item4=byGeometry_5)
byLayers = Plotter.Drawing.ByLayers(layers=list_create)
optimize = Plotter.Drawing.Optimize(drawing=byLayers)
svg_file_path = StringInput("D:\Drawing\PlotterNodes\output\numeral_3.svg")
code_block_20 = CodeBlock()
# ---------- code_block_20.designscript (2 lines) ----------
// includePageOutline
true;
# ----------------------------------------
exportSvg = Plotter.Drawing.ExportSvg(drawing=optimize, filePath=svg_file_path, includePageOutline=code_block_20)
statistics = Plotter.Drawing.Statistics(drawing=optimize)
watch = Watch(statistics.drawLength)
