# Dynamo graph Numeral_4.dyn (Dynamo 4.0.0.0)
# author: PlotterNodes samples
# PlotterNodes sample: Patchwork of nested rectangles (yellow and red) around a blocky 4 built from rectangles.
# packages: PlotterNodes 0.1.0

# group: 1. Numeral 4 from Dynamo curves
# Edit the curves in the first code block; any closed or open curves work.
code_block = CodeBlock()
# ---------- code_block.designscript (4 lines) ----------
// Outline of the 4: three overlapping closed rectangles, fused by Shape.Union below
[[PolyCurve.ByPoints([Point.ByCoordinates(150, 30), Point.ByCoordinates(176, 30), Point.ByCoordinates(176, 178), Point.ByCoordinates(150, 178)], true)],
 [PolyCurve.ByPoints([Point.ByCoordinates(104, 80), Point.ByCoordinates(198, 80), Point.ByCoordinates(198, 106), Point.ByCoordinates(104, 106)], true)],
 [PolyCurve.ByPoints([Point.ByCoordinates(104, 80), Point.ByCoordinates(130, 80), Point.ByCoordinates(130, 170), Point.ByCoordinates(104, 170)], true)]];
# ----------------------------------------
byCurves = Plotter.Shape.ByCurves(curves=code_block)
code_block_2 = CodeBlock()
# ---------- code_block_2.designscript (2 lines) ----------
// resolution
0.3;
# ----------------------------------------
union = Plotter.Shape.Union(shapes=byCurves, resolution=code_block_2)
code_block_3 = CodeBlock()
# ---------- code_block_3.designscript (4 lines) ----------
// iterations
2;
// ratio
0.2;
# ----------------------------------------
smooth = Plotter.Shape.Smooth(shape=union, iterations=code_block_3.out0, ratio=code_block_3.out1)
code_block_4 = CodeBlock()
# ---------- code_block_4.designscript (4 lines) ----------
// distance
15;
// resolution
0.3;
# ----------------------------------------
offset = Plotter.Shape.Offset(shape=smooth, distance=code_block_4.out0, resolution=code_block_4.out1)
code_block_5 = CodeBlock()
# ---------- code_block_5.designscript (4 lines) ----------
// distance
-6;
// resolution
0.3;
# ----------------------------------------
offset_2 = Plotter.Shape.Offset(shape=offset, distance=code_block_5.out0, resolution=code_block_5.out1)
code_block_6 = CodeBlock()
# ---------- code_block_6.designscript (4 lines) ----------
// distance
5;
// resolution
0.3;
# ----------------------------------------
offset_3 = Plotter.Shape.Offset(shape=smooth, distance=code_block_6.out0, resolution=code_block_6.out1)
code_block_7 = CodeBlock()
# ---------- code_block_7.designscript (4 lines) ----------
// distance
2.5;
// resolution
0.3;
# ----------------------------------------
offset_4 = Plotter.Shape.Offset(shape=smooth, distance=code_block_7.out0, resolution=code_block_7.out1)

# group: 2. Background pattern
# Seeds, cell sizes and ring gaps live in the code blocks next to each node.
code_block_8 = CodeBlock()
# ---------- code_block_8.designscript (6 lines) ----------
// width
297;
// height
210;
// margin
6;
# ----------------------------------------
region = Plotter.Page.Region(width=code_block_8.out0, height=code_block_8.out1, margin=code_block_8.out2)
code_block_9 = CodeBlock()
# ---------- code_block_9.designscript (18 lines) ----------
// minCell
22;
// maxCell
55;
// gap
4;
// ringGap
3.2;
// minRings
2;
// maxRings
5;
// jitter
1.2;
// seed
11;
// avoidMargin
2;
# ----------------------------------------
nestedRectangles = Plotter.Pattern.NestedRectangles(region=region, minCell=code_block_9.out0, maxCell=code_block_9.out1, gap=code_block_9.out2, ringGap=code_block_9.out3, minRings=code_block_9.out4, maxRings=code_block_9.out5, jitter=code_block_9.out6, seed=code_block_9.out7, avoid=smooth, avoidMargin=code_block_9.out8)
code_block_10 = CodeBlock()
# ---------- code_block_10.designscript (4 lines) ----------
// start
0;
// step
2;
# ----------------------------------------
selectRings = Plotter.Pattern.SelectRings(cells=nestedRectangles, start=code_block_10.out0, step=code_block_10.out1)
code_block_11 = CodeBlock()
# ---------- code_block_11.designscript (8 lines) ----------
// amplitude
0.5;
// wavelength
9;
// seed
1;
// octaves
2;
# ----------------------------------------
wobble = Plotter.Shape.Wobble(shape=selectRings, amplitude=code_block_11.out0, wavelength=code_block_11.out1, seed=code_block_11.out2, octaves=code_block_11.out3)
code_block_12 = CodeBlock()
# ---------- code_block_12.designscript (4 lines) ----------
// keepInside
false;
// resolution
0.3;
# ----------------------------------------
clip = Plotter.Shape.Clip(shape=offset_2, geometry=wobble, keepInside=code_block_12.out0, resolution=code_block_12.out1)
code_block_13 = CodeBlock()
# ---------- code_block_13.designscript (4 lines) ----------
// start
1;
// step
2;
# ----------------------------------------
selectRings_2 = Plotter.Pattern.SelectRings(cells=nestedRectangles, start=code_block_13.out0, step=code_block_13.out1)
code_block_14 = CodeBlock()
# ---------- code_block_14.designscript (8 lines) ----------
// amplitude
0.5;
// wavelength
9;
// seed
2;
// octaves
2;
# ----------------------------------------
wobble_2 = Plotter.Shape.Wobble(shape=selectRings_2, amplitude=code_block_14.out0, wavelength=code_block_14.out1, seed=code_block_14.out2, octaves=code_block_14.out3)
code_block_15 = CodeBlock()  # same code as code_block_12
clip_2 = Plotter.Shape.Clip(shape=offset_2, geometry=wobble_2, keepInside=code_block_15.out0, resolution=code_block_15.out1)

# group: 3. Pens, page and AxiDraw SVG
# One Layer per pen. Set the SVG path, then press Run.
code_block_16 = CodeBlock()
# ---------- code_block_16.designscript (8 lines) ----------
// name
"yellow";
// color
"#e3b23c";
// strokeWidth
0.5;
// penNumber
1;
# ----------------------------------------
byGeometry = Plotter.Layer.ByGeometry(name=code_block_16.out0, geometry=clip, color=code_block_16.out1, strokeWidth=code_block_16.out2, penNumber=code_block_16.out3)
code_block_17 = CodeBlock()
# ---------- code_block_17.designscript (8 lines) ----------
// name
"red";
// color
"#c8402f";
// strokeWidth
0.5;
// penNumber
2;
# ----------------------------------------
byGeometry_2 = Plotter.Layer.ByGeometry(name=code_block_17.out0, geometry=clip_2, color=code_block_17.out1, strokeWidth=code_block_17.out2, penNumber=code_block_17.out3)
code_block_18 = CodeBlock()
# ---------- code_block_18.designscript (8 lines) ----------
// name
"blue";
// color
"#2563eb";
// strokeWidth
0.6;
// penNumber
3;
# ----------------------------------------
code_block_19 = CodeBlock()
# ---------- code_block_19.designscript (8 lines) ----------
// amplitude
0.5;
// wavelength
14;
// seed
3;
// octaves
2;
# ----------------------------------------
wobble_3 = Plotter.Shape.Wobble(shape=smooth, amplitude=code_block_19.out0, wavelength=code_block_19.out1, seed=code_block_19.out2, octaves=code_block_19.out3)
code_block_20 = CodeBlock()
# ---------- code_block_20.designscript (8 lines) ----------
// amplitude
0.6;
// wavelength
14;
// seed
4;
// octaves
2;
# ----------------------------------------
wobble_4 = Plotter.Shape.Wobble(shape=offset_3, amplitude=code_block_20.out0, wavelength=code_block_20.out1, seed=code_block_20.out2, octaves=code_block_20.out3)
code_block_21 = CodeBlock()
# ---------- code_block_21.designscript (8 lines) ----------
// amplitude
0.5;
// wavelength
14;
// seed
5;
// octaves
2;
# ----------------------------------------
wobble_5 = Plotter.Shape.Wobble(shape=offset_4, amplitude=code_block_21.out0, wavelength=code_block_21.out1, seed=code_block_21.out2, octaves=code_block_21.out3)
list_create = List.Create(item0=wobble_3, item1=wobble_4, item2=wobble_5)
byGeometry_3 = Plotter.Layer.ByGeometry(name=code_block_18.out0, geometry=list_create, color=code_block_18.out1, strokeWidth=code_block_18.out2, penNumber=code_block_18.out3)
code_block_22 = CodeBlock()
# ---------- code_block_22.designscript (8 lines) ----------
// name
"fill";
// color
"#dbeafe";
// strokeWidth
0.3;
// penNumber
4;
# ----------------------------------------
code_block_23 = CodeBlock()
# ---------- code_block_23.designscript (6 lines) ----------
// spacing
1.5;
// angle
30;
// inset
1.5;
# ----------------------------------------
hatch = Plotter.Shape.Hatch(shape=smooth, spacing=code_block_23.out0, angle=code_block_23.out1, inset=code_block_23.out2)
byGeometry_4 = Plotter.Layer.ByGeometry(name=code_block_22.out0, geometry=hatch, color=code_block_22.out1, strokeWidth=code_block_22.out2, penNumber=code_block_22.out3)
list_create_2 = List.Create(item0=byGeometry, item1=byGeometry_2, item2=byGeometry_3, item3=byGeometry_4)
byLayers = Plotter.Drawing.ByLayers(layers=list_create_2)
optimize = Plotter.Drawing.Optimize(drawing=byLayers)
svg_file_path = StringInput("D:\Drawing\PlotterNodes\output\numeral_4.svg")
code_block_24 = CodeBlock()
# ---------- code_block_24.designscript (2 lines) ----------
// includePageOutline
true;
# ----------------------------------------
exportSvg = Plotter.Drawing.ExportSvg(drawing=optimize, filePath=svg_file_path, includePageOutline=code_block_24)
statistics = Plotter.Drawing.Statistics(drawing=optimize)
watch = Watch(statistics.drawLength)
