# Dynamo graph Numeral_5.dyn (Dynamo 4.0.0.0)
# author: PlotterNodes samples
# PlotterNodes sample: A field of small framed ovals around a 5 wrapped in green and red outlines.
# packages: PlotterNodes 0.1.0

# group: 1. Numeral 5 from Dynamo curves
# Edit the curves in the first code block; any closed or open curves work.
code_block = CodeBlock()
# ---------- code_block.designscript (4 lines) ----------
// Centre lines of the 5: top bar, upright and bowl arc; thickened to 22 mm below
[Line.ByStartPointEndPoint(Point.ByCoordinates(182, 172), Point.ByCoordinates(122, 172)),
 Line.ByStartPointEndPoint(Point.ByCoordinates(122, 172), Point.ByCoordinates(120.3, 108.6)),
 Arc.ByThreePoints(Point.ByCoordinates(120.3, 108.6), Point.ByCoordinates(185.8, 74.5), Point.ByCoordinates(115.4, 52.3))];
# ----------------------------------------
byCurve = Plotter.Polyline.ByCurve(curve=code_block)
code_block_2 = CodeBlock()
# ---------- code_block_2.designscript (4 lines) ----------
// resolution
0.3;
// padding
22;
# ----------------------------------------
byPolylines = Plotter.DistanceField.ByPolylines(polylines=byCurve, resolution=code_block_2.out0, padding=code_block_2.out1)
code_block_3 = CodeBlock()
# ---------- code_block_3.designscript (2 lines) ----------
// level
11;
# ----------------------------------------
contour = Plotter.DistanceField.Contour(distanceField=byPolylines, level=code_block_3)
code_block_4 = CodeBlock()
# ---------- code_block_4.designscript (4 lines) ----------
// distance
14;
// resolution
0.3;
# ----------------------------------------
offset = Plotter.Shape.Offset(shape=contour, distance=code_block_4.out0, resolution=code_block_4.out1)
code_block_5 = CodeBlock()
# ---------- code_block_5.designscript (4 lines) ----------
// distance
9;
// resolution
0.3;
# ----------------------------------------
offset_2 = Plotter.Shape.Offset(shape=contour, distance=code_block_5.out0, resolution=code_block_5.out1)
code_block_6 = CodeBlock()
# ---------- code_block_6.designscript (4 lines) ----------
// distance
4.5;
// resolution
0.3;
# ----------------------------------------
offset_3 = Plotter.Shape.Offset(shape=contour, distance=code_block_6.out0, resolution=code_block_6.out1)

# group: 2. Background pattern
# Seeds, cell sizes and ring gaps live in the code blocks next to each node.
code_block_7 = CodeBlock()
# ---------- code_block_7.designscript (6 lines) ----------
// width
297;
// height
210;
// margin
6;
# ----------------------------------------
region = Plotter.Page.Region(width=code_block_7.out0, height=code_block_7.out1, margin=code_block_7.out2)
code_block_8 = CodeBlock()
# ---------- code_block_8.designscript (18 lines) ----------
// cellWidth
15;
// cellHeight
12;
// gap
4;
// rings
2;
// ringGap
3.5;
// innerShape
"ellipse";
// jitter
0.8;
// seed
5;
// avoidMargin
0;
# ----------------------------------------
grid = Plotter.Pattern.Grid(region=region, cellWidth=code_block_8.out0, cellHeight=code_block_8.out1, gap=code_block_8.out2, rings=code_block_8.out3, ringGap=code_block_8.out4, innerShape=code_block_8.out5, jitter=code_block_8.out6, seed=code_block_8.out7, avoid=offset, avoidMargin=code_block_8.out8)
code_block_9 = CodeBlock()
# ---------- code_block_9.designscript (4 lines) ----------
// start
0;
// step
0;
# ----------------------------------------
selectRings = Plotter.Pattern.SelectRings(cells=grid, start=code_block_9.out0, step=code_block_9.out1)
code_block_10 = CodeBlock()
# ---------- code_block_10.designscript (8 lines) ----------
// amplitude
0.4;
// wavelength
7;
// seed
1;
// octaves
2;
# ----------------------------------------
wobble = Plotter.Shape.Wobble(shape=selectRings, amplitude=code_block_10.out0, wavelength=code_block_10.out1, seed=code_block_10.out2, octaves=code_block_10.out3)
code_block_11 = CodeBlock()
# ---------- code_block_11.designscript (4 lines) ----------
// keepInside
false;
// resolution
0.3;
# ----------------------------------------
clip = Plotter.Shape.Clip(shape=offset, geometry=wobble, keepInside=code_block_11.out0, resolution=code_block_11.out1)
code_block_12 = CodeBlock()
# ---------- code_block_12.designscript (4 lines) ----------
// start
1;
// step
0;
# ----------------------------------------
selectRings_2 = Plotter.Pattern.SelectRings(cells=grid, start=code_block_12.out0, step=code_block_12.out1)
code_block_13 = CodeBlock()
# ---------- code_block_13.designscript (8 lines) ----------
// amplitude
0.3;
// wavelength
5;
// seed
2;
// octaves
2;
# ----------------------------------------
wobble_2 = Plotter.Shape.Wobble(shape=selectRings_2, amplitude=code_block_13.out0, wavelength=code_block_13.out1, seed=code_block_13.out2, octaves=code_block_13.out3)
code_block_14 = CodeBlock()  # same code as code_block_11
clip_2 = Plotter.Shape.Clip(shape=offset, geometry=wobble_2, keepInside=code_block_14.out0, resolution=code_block_14.out1)

# group: 3. Pens, page and AxiDraw SVG
# One Layer per pen. Set the SVG path, then press Run.
code_block_15 = CodeBlock()
# ---------- code_block_15.designscript (8 lines) ----------
// name
"pink";
// color
"#ff8fd8";
// strokeWidth
0.6;
// penNumber
1;
# ----------------------------------------
byGeometry = Plotter.Layer.ByGeometry(name=code_block_15.out0, geometry=clip, color=code_block_15.out1, strokeWidth=code_block_15.out2, penNumber=code_block_15.out3)
code_block_16 = CodeBlock()
# ---------- code_block_16.designscript (8 lines) ----------
// name
"red";
// color
"#e63946";
// strokeWidth
0.6;
// penNumber
2;
# ----------------------------------------
code_block_17 = CodeBlock()
# ---------- code_block_17.designscript (8 lines) ----------
// amplitude
0.6;
// wavelength
16;
// seed
3;
// octaves
2;
# ----------------------------------------
wobble_3 = Plotter.Shape.Wobble(shape=offset_2, amplitude=code_block_17.out0, wavelength=code_block_17.out1, seed=code_block_17.out2, octaves=code_block_17.out3)
code_block_18 = CodeBlock()
# ---------- code_block_18.designscript (8 lines) ----------
// amplitude
0.6;
// wavelength
16;
// seed
4;
// octaves
2;
# ----------------------------------------
wobble_4 = Plotter.Shape.Wobble(shape=offset, amplitude=code_block_18.out0, wavelength=code_block_18.out1, seed=code_block_18.out2, octaves=code_block_18.out3)
list_create = List.Create(item0=clip_2, item1=wobble_3, item2=wobble_4)
byGeometry_2 = Plotter.Layer.ByGeometry(name=code_block_16.out0, geometry=list_create, color=code_block_16.out1, strokeWidth=code_block_16.out2, penNumber=code_block_16.out3)
code_block_19 = CodeBlock()
# ---------- code_block_19.designscript (8 lines) ----------
// name
"green";
// color
"#2a9d8f";
// strokeWidth
0.6;
// penNumber
3;
# ----------------------------------------
code_block_20 = CodeBlock()
# ---------- code_block_20.designscript (8 lines) ----------
// amplitude
0.5;
// wavelength
14;
// seed
5;
// octaves
2;
# ----------------------------------------
wobble_5 = Plotter.Shape.Wobble(shape=offset_3, amplitude=code_block_20.out0, wavelength=code_block_20.out1, seed=code_block_20.out2, octaves=code_block_20.out3)
byGeometry_3 = Plotter.Layer.ByGeometry(name=code_block_19.out0, geometry=wobble_5, color=code_block_19.out1, strokeWidth=code_block_19.out2, penNumber=code_block_19.out3)
code_block_21 = CodeBlock()
# ---------- code_block_21.designscript (8 lines) ----------
// name
"numeral";
// color
"#8ecae6";
// strokeWidth
0.6;
// penNumber
4;
# ----------------------------------------
code_block_22 = CodeBlock()
# ---------- code_block_22.designscript (8 lines) ----------
// amplitude
0.4;
// wavelength
14;
// seed
6;
// octaves
2;
# ----------------------------------------
wobble_6 = Plotter.Shape.Wobble(shape=contour, amplitude=code_block_22.out0, wavelength=code_block_22.out1, seed=code_block_22.out2, octaves=code_block_22.out3)
byGeometry_4 = Plotter.Layer.ByGeometry(name=code_block_21.out0, geometry=wobble_6, color=code_block_21.out1, strokeWidth=code_block_21.out2, penNumber=code_block_21.out3)
code_block_23 = CodeBlock()
# ---------- code_block_23.designscript (8 lines) ----------
// name
"fill";
// color
"#e3f2fd";
// strokeWidth
0.3;
// penNumber
5;
# ----------------------------------------
code_block_24 = CodeBlock()
# ---------- code_block_24.designscript (6 lines) ----------
// spacing
1.8;
// angle
60;
// inset
1.5;
# ----------------------------------------
hatch = Plotter.Shape.Hatch(shape=contour, spacing=code_block_24.out0, angle=code_block_24.out1, inset=code_block_24.out2)
byGeometry_5 = Plotter.Layer.ByGeometry(name=code_block_23.out0, geometry=hatch, color=code_block_23.out1, strokeWidth=code_block_23.out2, penNumber=code_block_23.out3)
list_create_2 = List.Create(item0=byGeometry, item1=byGeometry_2, item2=byGeometry_3, item3=byGeometry_4, item4=byGeometry_5)
byLayers = Plotter.Drawing.ByLayers(layers=list_create_2)
optimize = Plotter.Drawing.Optimize(drawing=byLayers)
svg_file_path = StringInput("D:\Drawing\PlotterNodes\output\numeral_5.svg")
code_block_25 = CodeBlock()
# ---------- code_block_25.designscript (2 lines) ----------
// includePageOutline
true;
# ----------------------------------------
exportSvg = Plotter.Drawing.ExportSvg(drawing=optimize, filePath=svg_file_path, includePageOutline=code_block_25)
statistics = Plotter.Drawing.Statistics(drawing=optimize)
watch = Watch(statistics.drawLength)
