# Dynamo graph Numeral_6.dyn (Dynamo 4.0.0.0)
# author: PlotterNodes samples
# PlotterNodes sample: Thick spiral scrolls swirling around a 6.
# packages: PlotterNodes 0.1.0

# group: 1. Numeral 6 from Dynamo curves
# Edit the curves in the first code block; any closed or open curves work.
code_block = CodeBlock()
# ---------- code_block.designscript (3 lines) ----------
// Centre lines of the 6: bowl circle and rising tail arc; thickened to 24 mm below
[Circle.ByCenterPointRadius(Point.ByCoordinates(150, 76), 38),
 Arc.ByThreePoints(Point.ByCoordinates(112.2, 80), Point.ByCoordinates(124, 142), Point.ByCoordinates(178, 170))];
# ----------------------------------------
byCurve = Plotter.Polyline.ByCurve(curve=code_block)
code_block_2 = CodeBlock()
# ---------- code_block_2.designscript (4 lines) ----------
// resolution
0.3;
// padding
24;
# ----------------------------------------
byPolylines = Plotter.DistanceField.ByPolylines(polylines=byCurve, resolution=code_block_2.out0, padding=code_block_2.out1)
code_block_3 = CodeBlock()
# ---------- code_block_3.designscript (2 lines) ----------
// level
12;
# ----------------------------------------
contour = Plotter.DistanceField.Contour(distanceField=byPolylines, level=code_block_3)
code_block_4 = CodeBlock()
# ---------- code_block_4.designscript (4 lines) ----------
// distance
7;
// resolution
0.3;
# ----------------------------------------
offset = Plotter.Shape.Offset(shape=contour, distance=code_block_4.out0, resolution=code_block_4.out1)
fillHoles = Plotter.Shape.FillHoles(shape=offset)
holesOnly = Plotter.Shape.HolesOnly(shape=contour)
code_block_5 = CodeBlock()
# ---------- code_block_5.designscript (8 lines) ----------
// spacing
4;
// firstOffset
3;
// maxCount
3;
// resolution
0.3;
# ----------------------------------------
innerRings = Plotter.Shape.InnerRings(shape=holesOnly, spacing=code_block_5.out0, firstOffset=code_block_5.out1, maxCount=code_block_5.out2, resolution=code_block_5.out3)
code_block_6 = CodeBlock()
# ---------- code_block_6.designscript (4 lines) ----------
// distance
2.5;
// resolution
0.3;
# ----------------------------------------
offset_2 = Plotter.Shape.Offset(shape=contour, distance=code_block_6.out0, resolution=code_block_6.out1)

# group: 2. Background pattern
# Seeds, cell sizes and ring gaps live in the code blocks next to each node.
code_block_7 = CodeBlock()
# ---------- code_block_7.designscript (6 lines) ----------
// width
297;
// height
210;
// margin
6;
# ----------------------------------------
region = Plotter.Page.Region(width=code_block_7.out0, height=code_block_7.out1, margin=code_block_7.out2)
code_block_8 = CodeBlock()
# ---------- code_block_8.designscript (14 lines) ----------
// minRadius
14;
// maxRadius
32;
// turns
2.3;
// spacing
6;
// seed
6;
// avoidMargin
3;
// attempts
4000;
# ----------------------------------------
spirals = Plotter.Pattern.Spirals(region=region, minRadius=code_block_8.out0, maxRadius=code_block_8.out1, turns=code_block_8.out2, spacing=code_block_8.out3, seed=code_block_8.out4, avoid=fillHoles, avoidMargin=code_block_8.out5, attempts=code_block_8.out6)
code_block_9 = CodeBlock()
# ---------- code_block_9.designscript (4 lines) ----------
// width
7;
// resolution
0.3;
# ----------------------------------------
outline = Plotter.Polyline.Outline(polyline=spirals, width=code_block_9.out0, resolution=code_block_9.out1)

# group: 3. Pens, page and AxiDraw SVG
# One Layer per pen. Set the SVG path, then press Run.
code_block_10 = CodeBlock()
# ---------- code_block_10.designscript (8 lines) ----------
// name
"blue";
// color
"#2a7fd4";
// strokeWidth
0.6;
// penNumber
1;
# ----------------------------------------
code_block_11 = CodeBlock()
# ---------- code_block_11.designscript (8 lines) ----------
// amplitude
0.5;
// wavelength
12;
// seed
1;
// octaves
2;
# ----------------------------------------
wobble = Plotter.Shape.Wobble(shape=outline, amplitude=code_block_11.out0, wavelength=code_block_11.out1, seed=code_block_11.out2, octaves=code_block_11.out3)
code_block_12 = CodeBlock()
# ---------- code_block_12.designscript (8 lines) ----------
// amplitude
0.4;
// wavelength
10;
// seed
6;
// octaves
2;
# ----------------------------------------
wobble_2 = Plotter.Shape.Wobble(shape=innerRings, amplitude=code_block_12.out0, wavelength=code_block_12.out1, seed=code_block_12.out2, octaves=code_block_12.out3)
list_create = List.Create(item0=wobble, item1=wobble_2)
byGeometry = Plotter.Layer.ByGeometry(name=code_block_10.out0, geometry=list_create, color=code_block_10.out1, strokeWidth=code_block_10.out2, penNumber=code_block_10.out3)
code_block_13 = CodeBlock()
# ---------- code_block_13.designscript (8 lines) ----------
// name
"light";
// color
"#9dd6ff";
// strokeWidth
0.4;
// penNumber
2;
# ----------------------------------------
code_block_14 = CodeBlock()
# ---------- code_block_14.designscript (8 lines) ----------
// amplitude
0.4;
// wavelength
10;
// seed
2;
// octaves
2;
# ----------------------------------------
wobble_3 = Plotter.Polyline.Wobble(polyline=spirals, amplitude=code_block_14.out0, wavelength=code_block_14.out1, seed=code_block_14.out2, octaves=code_block_14.out3)
byGeometry_2 = Plotter.Layer.ByGeometry(name=code_block_13.out0, geometry=wobble_3, color=code_block_13.out1, strokeWidth=code_block_13.out2, penNumber=code_block_13.out3)
code_block_15 = CodeBlock()
# ---------- code_block_15.designscript (8 lines) ----------
// name
"numeral";
// color
"#1e40af";
// strokeWidth
0.6;
// penNumber
3;
# ----------------------------------------
code_block_16 = CodeBlock()
# ---------- code_block_16.designscript (8 lines) ----------
// amplitude
0.5;
// wavelength
14;
// seed
3;
// octaves
2;
# ----------------------------------------
wobble_4 = Plotter.Shape.Wobble(shape=contour, amplitude=code_block_16.out0, wavelength=code_block_16.out1, seed=code_block_16.out2, octaves=code_block_16.out3)
code_block_17 = CodeBlock()
# ---------- code_block_17.designscript (8 lines) ----------
// amplitude
0.6;
// wavelength
16;
// seed
4;
// octaves
2;
# ----------------------------------------
wobble_5 = Plotter.Shape.Wobble(shape=offset, amplitude=code_block_17.out0, wavelength=code_block_17.out1, seed=code_block_17.out2, octaves=code_block_17.out3)
code_block_18 = CodeBlock()
# ---------- code_block_18.designscript (8 lines) ----------
// amplitude
0.5;
// wavelength
14;
// seed
5;
// octaves
2;
# ----------------------------------------
wobble_6 = Plotter.Shape.Wobble(shape=offset_2, amplitude=code_block_18.out0, wavelength=code_block_18.out1, seed=code_block_18.out2, octaves=code_block_18.out3)
list_create_2 = List.Create(item0=wobble_4, item1=wobble_5, item2=wobble_6)
byGeometry_3 = Plotter.Layer.ByGeometry(name=code_block_15.out0, geometry=list_create_2, color=code_block_15.out1, strokeWidth=code_block_15.out2, penNumber=code_block_15.out3)
code_block_19 = CodeBlock()
# ---------- code_block_19.designscript (8 lines) ----------
// name
"fill";
// color
"#e0e7ff";
// strokeWidth
0.3;
// penNumber
4;
# ----------------------------------------
code_block_20 = CodeBlock()
# ---------- code_block_20.designscript (6 lines) ----------
// spacing
1.8;
// angle
60;
// inset
1.5;
# ----------------------------------------
hatch = Plotter.Shape.Hatch(shape=contour, spacing=code_block_20.out0, angle=code_block_20.out1, inset=code_block_20.out2)
byGeometry_4 = Plotter.Layer.ByGeometry(name=code_block_19.out0, geometry=hatch, color=code_block_19.out1, strokeWidth=code_block_19.out2, penNumber=code_block_19.out3)
list_create_3 = List.Create(item0=byGeometry, item1=byGeometry_2, item2=byGeometry_3, item3=byGeometry_4)
byLayers = Plotter.Drawing.ByLayers(layers=list_create_3)
optimize = Plotter.Drawing.Optimize(drawing=byLayers)
svg_file_path = StringInput("D:\Drawing\PlotterNodes\output\numeral_6.svg")
code_block_21 = CodeBlock()
# ---------- code_block_21.designscript (2 lines) ----------
// includePageOutline
true;
# ----------------------------------------
exportSvg = Plotter.Drawing.ExportSvg(drawing=optimize, filePath=svg_file_path, includePageOutline=code_block_21)
statistics = Plotter.Drawing.Statistics(drawing=optimize)
watch = Watch(statistics.drawLength)
