# Dynamo graph Numeral_7.dyn (Dynamo 4.0.0.0)
# author: PlotterNodes samples
# PlotterNodes sample: A grid of square frames in pink, yellow and red around a 7 with a green halo.
# packages: PlotterNodes 0.1.0

# group: 1. Numeral 7 from Dynamo curves
# Edit the curves in the first code block; any closed or open curves work.
code_block = CodeBlock()
# ---------- code_block.designscript (3 lines) ----------
// Centre lines of the 7: top bar and diagonal; thickened to 24 mm below
[Line.ByStartPointEndPoint(Point.ByCoordinates(108, 170), Point.ByCoordinates(188, 170)),
 Line.ByStartPointEndPoint(Point.ByCoordinates(188, 170), Point.ByCoordinates(136, 36))];
# ----------------------------------------
byCurve = Plotter.Polyline.ByCurve(curve=code_block)
code_block_2 = CodeBlock()
# ---------- code_block_2.designscript (4 lines) ----------
// resolution
0.3;
// padding
24;
# ----------------------------------------
byPolylines = Plotter.DistanceField.ByPolylines(polylines=byCurve, resolution=code_block_2.out0, padding=code_block_2.out1)
code_block_3 = CodeBlock()
# ---------- code_block_3.designscript (2 lines) ----------
// level
12;
# ----------------------------------------
contour = Plotter.DistanceField.Contour(distanceField=byPolylines, level=code_block_3)
code_block_4 = CodeBlock()
# ---------- code_block_4.designscript (4 lines) ----------
// distance
10;
// resolution
0.3;
# ----------------------------------------
offset = Plotter.Shape.Offset(shape=contour, distance=code_block_4.out0, resolution=code_block_4.out1)
code_block_5 = CodeBlock()
# ---------- code_block_5.designscript (4 lines) ----------
// distance
6;
// resolution
0.3;
# ----------------------------------------
offset_2 = Plotter.Shape.Offset(shape=contour, distance=code_block_5.out0, resolution=code_block_5.out1)

# group: 2. Background pattern
# Seeds, cell sizes and ring gaps live in the code blocks next to each node.
code_block_6 = CodeBlock()
# ---------- code_block_6.designscript (6 lines) ----------
// width
297;
// height
210;
// margin
6;
# ----------------------------------------
region = Plotter.Page.Region(width=code_block_6.out0, height=code_block_6.out1, margin=code_block_6.out2)
code_block_7 = CodeBlock()
# ---------- code_block_7.designscript (18 lines) ----------
// cellWidth
30;
// cellHeight
30;
// gap
4;
// rings
3;
// ringGap
5;
// innerShape
"rectangle";
// jitter
1.5;
// seed
7;
// avoidMargin
0;
# ----------------------------------------
grid = Plotter.Pattern.Grid(region=region, cellWidth=code_block_7.out0, cellHeight=code_block_7.out1, gap=code_block_7.out2, rings=code_block_7.out3, ringGap=code_block_7.out4, innerShape=code_block_7.out5, jitter=code_block_7.out6, seed=code_block_7.out7, avoid=offset, avoidMargin=code_block_7.out8)
code_block_8 = CodeBlock()
# ---------- code_block_8.designscript (4 lines) ----------
// start
0;
// step
0;
# ----------------------------------------
selectRings = Plotter.Pattern.SelectRings(cells=grid, start=code_block_8.out0, step=code_block_8.out1)
code_block_9 = CodeBlock()
# ---------- code_block_9.designscript (8 lines) ----------
// amplitude
0.6;
// wavelength
10;
// seed
1;
// octaves
2;
# ----------------------------------------
wobble = Plotter.Shape.Wobble(shape=selectRings, amplitude=code_block_9.out0, wavelength=code_block_9.out1, seed=code_block_9.out2, octaves=code_block_9.out3)
code_block_10 = CodeBlock()
# ---------- code_block_10.designscript (4 lines) ----------
// keepInside
false;
// resolution
0.3;
# ----------------------------------------
clip = Plotter.Shape.Clip(shape=offset, geometry=wobble, keepInside=code_block_10.out0, resolution=code_block_10.out1)
code_block_11 = CodeBlock()
# ---------- code_block_11.designscript (4 lines) ----------
// start
1;
// step
0;
# ----------------------------------------
selectRings_2 = Plotter.Pattern.SelectRings(cells=grid, start=code_block_11.out0, step=code_block_11.out1)
code_block_12 = CodeBlock()
# ---------- code_block_12.designscript (8 lines) ----------
// amplitude
0.5;
// wavelength
9;
// seed
2;
// octaves
2;
# ----------------------------------------
wobble_2 = Plotter.Shape.Wobble(shape=selectRings_2, amplitude=code_block_12.out0, wavelength=code_block_12.out1, seed=code_block_12.out2, octaves=code_block_12.out3)
code_block_13 = CodeBlock()  # same code as code_block_10
clip_2 = Plotter.Shape.Clip(shape=offset, geometry=wobble_2, keepInside=code_block_13.out0, resolution=code_block_13.out1)
code_block_14 = CodeBlock()
# ---------- code_block_14.designscript (4 lines) ----------
// start
2;
// step
0;
# ----------------------------------------
selectRings_3 = Plotter.Pattern.SelectRings(cells=grid, start=code_block_14.out0, step=code_block_14.out1)
code_block_15 = CodeBlock()
# ---------- code_block_15.designscript (8 lines) ----------
// amplitude
0.4;
// wavelength
8;
// seed
3;
// octaves
2;
# ----------------------------------------
wobble_3 = Plotter.Shape.Wobble(shape=selectRings_3, amplitude=code_block_15.out0, wavelength=code_block_15.out1, seed=code_block_15.out2, octaves=code_block_15.out3)
code_block_16 = CodeBlock()  # same code as code_block_10
clip_3 = Plotter.Shape.Clip(shape=offset, geometry=wobble_3, keepInside=code_block_16.out0, resolution=code_block_16.out1)

# group: 3. Pens, page and AxiDraw SVG
# One Layer per pen. Set the SVG path, then press Run.
code_block_17 = CodeBlock()
# ---------- code_block_17.designscript (8 lines) ----------
// name
"pink";
// color
"#e879c6";
// strokeWidth
0.7;
// penNumber
1;
# ----------------------------------------
code_block_18 = CodeBlock()
# ---------- code_block_18.designscript (8 lines) ----------
// amplitude
0.5;
// wavelength
14;
// seed
4;
// octaves
2;
# ----------------------------------------
wobble_4 = Plotter.Shape.Wobble(shape=contour, amplitude=code_block_18.out0, wavelength=code_block_18.out1, seed=code_block_18.out2, octaves=code_block_18.out3)
list_create = List.Create(item0=clip, item1=wobble_4)
byGeometry = Plotter.Layer.ByGeometry(name=code_block_17.out0, geometry=list_create, color=code_block_17.out1, strokeWidth=code_block_17.out2, penNumber=code_block_17.out3)
code_block_19 = CodeBlock()
# ---------- code_block_19.designscript (8 lines) ----------
// name
"yellow";
// color
"#f2c14e";
// strokeWidth
0.6;
// penNumber
2;
# ----------------------------------------
byGeometry_2 = Plotter.Layer.ByGeometry(name=code_block_19.out0, geometry=clip_2, color=code_block_19.out1, strokeWidth=code_block_19.out2, penNumber=code_block_19.out3)
code_block_20 = CodeBlock()
# ---------- code_block_20.designscript (8 lines) ----------
// name
"red";
// color
"#d64933";
// strokeWidth
0.6;
// penNumber
3;
# ----------------------------------------
byGeometry_3 = Plotter.Layer.ByGeometry(name=code_block_20.out0, geometry=clip_3, color=code_block_20.out1, strokeWidth=code_block_20.out2, penNumber=code_block_20.out3)
code_block_21 = CodeBlock()
# ---------- code_block_21.designscript (8 lines) ----------
// name
"green";
// color
"#9ad94f";
// strokeWidth
0.6;
// penNumber
4;
# ----------------------------------------
code_block_22 = CodeBlock()
# ---------- code_block_22.designscript (8 lines) ----------
// amplitude
0.6;
// wavelength
16;
// seed
5;
// octaves
2;
# ----------------------------------------
wobble_5 = Plotter.Shape.Wobble(shape=offset_2, amplitude=code_block_22.out0, wavelength=code_block_22.out1, seed=code_block_22.out2, octaves=code_block_22.out3)
code_block_23 = CodeBlock()
# ---------- code_block_23.designscript (8 lines) ----------
// amplitude
0.6;
// wavelength
16;
// seed
6;
// octaves
2;
# ----------------------------------------
wobble_6 = Plotter.Shape.Wobble(shape=offset, amplitude=code_block_23.out0, wavelength=code_block_23.out1, seed=code_block_23.out2, octaves=code_block_23.out3)
list_create_2 = List.Create(item0=wobble_5, item1=wobble_6)
byGeometry_4 = Plotter.Layer.ByGeometry(name=code_block_21.out0, geometry=list_create_2, color=code_block_21.out1, strokeWidth=code_block_21.out2, penNumber=code_block_21.out3)
code_block_24 = CodeBlock()
# ---------- code_block_24.designscript (8 lines) ----------
// name
"fill";
// color
"#eef0ff";
// strokeWidth
0.3;
// penNumber
5;
# ----------------------------------------
code_block_25 = CodeBlock()
# ---------- code_block_25.designscript (6 lines) ----------
// spacing
1.8;
// angle
60;
// inset
1.5;
# ----------------------------------------
hatch = Plotter.Shape.Hatch(shape=contour, spacing=code_block_25.out0, angle=code_block_25.out1, inset=code_block_25.out2)
byGeometry_5 = Plotter.Layer.ByGeometry(name=code_block_24.out0, geometry=hatch, color=code_block_24.out1, strokeWidth=code_block_24.out2, penNumber=code_block_24.out3)
list_create_3 = List.Create(item0=byGeometry, item1=byGeometry_2, item2=byGeometry_3, item3=byGeometry_4, item4=byGeometry_5)
byLayers = Plotter.Drawing.ByLayers(layers=list_create_3)
optimize = Plotter.Drawing.Optimize(drawing=byLayers)
svg_file_path = StringInput("D:\Drawing\PlotterNodes\output\numeral_7.svg")
code_block_26 = CodeBlock()
# ---------- code_block_26.designscript (2 lines) ----------
// includePageOutline
true;
# ----------------------------------------
exportSvg = Plotter.Drawing.ExportSvg(drawing=optimize, filePath=svg_file_path, includePageOutline=code_block_26)
statistics = Plotter.Drawing.Statistics(drawing=optimize)
watch = Watch(statistics.drawLength)
