# Dynamo graph Numeral_8.dyn (Dynamo 4.0.0.0)
# author: PlotterNodes samples
# PlotterNodes sample: Wobbling concentric contours radiating across the whole page from an 8.
# packages: PlotterNodes 0.1.0

# group: 1. Numeral 8 from Dynamo curves
# Edit the curves in the first code block; any closed or open curves work.
code_block = CodeBlock()
# ---------- code_block.designscript (3 lines) ----------
// Centre lines of the 8: two circles; thickened to 22 mm below
[Circle.ByCenterPointRadius(Point.ByCoordinates(148.5, 136), 26),
 Circle.ByCenterPointRadius(Point.ByCoordinates(148.5, 71), 34)];
# ----------------------------------------
byCurve = Plotter.Polyline.ByCurve(curve=code_block)
code_block_2 = CodeBlock()
# ---------- code_block_2.designscript (4 lines) ----------
// resolution
0.3;
// padding
22;
# ----------------------------------------
byPolylines = Plotter.DistanceField.ByPolylines(polylines=byCurve, resolution=code_block_2.out0, padding=code_block_2.out1)
code_block_3 = CodeBlock()
# ---------- code_block_3.designscript (2 lines) ----------
// level
11;
# ----------------------------------------
contour = Plotter.DistanceField.Contour(distanceField=byPolylines, level=code_block_3)
holesOnly = Plotter.Shape.HolesOnly(shape=contour)
code_block_4 = CodeBlock()
# ---------- code_block_4.designscript (8 lines) ----------
// spacing
3;
// firstOffset
2.5;
// maxCount
10;
// resolution
0.3;
# ----------------------------------------
innerRings = Plotter.Shape.InnerRings(shape=holesOnly, spacing=code_block_4.out0, firstOffset=code_block_4.out1, maxCount=code_block_4.out2, resolution=code_block_4.out3)

# group: 2. Background pattern
# Seeds, cell sizes and ring gaps live in the code blocks next to each node.
code_block_5 = CodeBlock()
# ---------- code_block_5.designscript (6 lines) ----------
// width
297;
// height
210;
// margin
6;
# ----------------------------------------
region = Plotter.Page.Region(width=code_block_5.out0, height=code_block_5.out1, margin=code_block_5.out2)
code_block_6 = CodeBlock()
# ---------- code_block_6.designscript (4 lines) ----------
// resolution
0.4;
// padding
180;
# ----------------------------------------
byShape = Plotter.DistanceField.ByShape(shape=contour, resolution=code_block_6.out0, padding=code_block_6.out1)
code_block_7 = CodeBlock()
# ---------- code_block_7.designscript (8 lines) ----------
// amplitude
1.5;
// wavelength
40;
// seed
8;
// octaves
2;
# ----------------------------------------
perturb = Plotter.DistanceField.Perturb(distanceField=byShape, amplitude=code_block_7.out0, wavelength=code_block_7.out1, seed=code_block_7.out2, octaves=code_block_7.out3)
code_block_8 = CodeBlock()
# ---------- code_block_8.designscript (2 lines) ----------
// levels
[4, 16, 28, 40, 52, 64, 76, 88, 100, 112, 124, 136, 148, 160, 172];
# ----------------------------------------
contours = Plotter.DistanceField.Contours(distanceField=perturb, levels=code_block_8)
code_block_9 = CodeBlock()
# ---------- code_block_9.designscript (4 lines) ----------
// keepInside
true;
// resolution
0.4;
# ----------------------------------------
clip = Plotter.Shape.Clip(shape=region, geometry=contours, keepInside=code_block_9.out0, resolution=code_block_9.out1)
code_block_10 = CodeBlock()
# ---------- code_block_10.designscript (2 lines) ----------
// levels
[10, 22, 34, 46, 58, 70, 82, 94, 106, 118, 130, 142, 154, 166, 178];
# ----------------------------------------
contours_2 = Plotter.DistanceField.Contours(distanceField=perturb, levels=code_block_10)
code_block_11 = CodeBlock()  # same code as code_block_9
clip_2 = Plotter.Shape.Clip(shape=region, geometry=contours_2, keepInside=code_block_11.out0, resolution=code_block_11.out1)

# group: 3. Pens, page and AxiDraw SVG
# One Layer per pen. Set the SVG path, then press Run.
code_block_12 = CodeBlock()
# ---------- code_block_12.designscript (8 lines) ----------
// name
"blue";
// color
"#1d4ed8";
// strokeWidth
0.6;
// penNumber
1;
# ----------------------------------------
byGeometry = Plotter.Layer.ByGeometry(name=code_block_12.out0, geometry=clip, color=code_block_12.out1, strokeWidth=code_block_12.out2, penNumber=code_block_12.out3)
code_block_13 = CodeBlock()
# ---------- code_block_13.designscript (8 lines) ----------
// name
"green";
// color
"#a3c93a";
// strokeWidth
0.6;
// penNumber
2;
# ----------------------------------------
byGeometry_2 = Plotter.Layer.ByGeometry(name=code_block_13.out0, geometry=clip_2, color=code_block_13.out1, strokeWidth=code_block_13.out2, penNumber=code_block_13.out3)
code_block_14 = CodeBlock()
# ---------- code_block_14.designscript (8 lines) ----------
// name
"teal";
// color
"#14b8a6";
// strokeWidth
0.6;
// penNumber
3;
# ----------------------------------------
code_block_15 = CodeBlock()
# ---------- code_block_15.designscript (8 lines) ----------
// amplitude
0.4;
// wavelength
14;
// seed
3;
// octaves
2;
# ----------------------------------------
wobble = Plotter.Shape.Wobble(shape=contour, amplitude=code_block_15.out0, wavelength=code_block_15.out1, seed=code_block_15.out2, octaves=code_block_15.out3)
code_block_16 = CodeBlock()
# ---------- code_block_16.designscript (8 lines) ----------
// amplitude
0.3;
// wavelength
8;
// seed
4;
// octaves
2;
# ----------------------------------------
wobble_2 = Plotter.Shape.Wobble(shape=innerRings, amplitude=code_block_16.out0, wavelength=code_block_16.out1, seed=code_block_16.out2, octaves=code_block_16.out3)
list_create = List.Create(item0=wobble, item1=wobble_2)
byGeometry_3 = Plotter.Layer.ByGeometry(name=code_block_14.out0, geometry=list_create, color=code_block_14.out1, strokeWidth=code_block_14.out2, penNumber=code_block_14.out3)
code_block_17 = CodeBlock()
# ---------- code_block_17.designscript (8 lines) ----------
// name
"fill";
// color
"#e6ecff";
// strokeWidth
0.3;
// penNumber
4;
# ----------------------------------------
code_block_18 = CodeBlock()
# ---------- code_block_18.designscript (6 lines) ----------
// spacing
1.8;
// angle
60;
// inset
1.5;
# ----------------------------------------
hatch = Plotter.Shape.Hatch(shape=contour, spacing=code_block_18.out0, angle=code_block_18.out1, inset=code_block_18.out2)
byGeometry_4 = Plotter.Layer.ByGeometry(name=code_block_17.out0, geometry=hatch, color=code_block_17.out1, strokeWidth=code_block_17.out2, penNumber=code_block_17.out3)
list_create_2 = List.Create(item0=byGeometry, item1=byGeometry_2, item2=byGeometry_3, item3=byGeometry_4)
byLayers = Plotter.Drawing.ByLayers(layers=list_create_2)
optimize = Plotter.Drawing.Optimize(drawing=byLayers)
svg_file_path = StringInput("D:\Drawing\PlotterNodes\output\numeral_8.svg")
code_block_19 = CodeBlock()
# ---------- code_block_19.designscript (2 lines) ----------
// includePageOutline
true;
# ----------------------------------------
exportSvg = Plotter.Drawing.ExportSvg(drawing=optimize, filePath=svg_file_path, includePageOutline=code_block_19)
statistics = Plotter.Drawing.Statistics(drawing=optimize)
watch = Watch(statistics.drawLength)
