# Dynamo graph PlotterNodes_Numeral8.dyn (Dynamo 4.0.0.0)
# PlotterNodes sample: a numeral built from Dynamo circles, radiating concentric rings, hatch fill, pen layers and AxiDraw SVG export.
# packages: PlotterNodes 0.1.0

# group: 1. Numeral from Dynamo curves
code_block = CodeBlock()
# ---------- code_block.designscript (5 lines) ----------
// Outer lobes and counters of the numeral, in page millimetres.
outer = [Circle.ByCenterPointRadius(Point.ByCoordinates(148.5, 129), 24),
         Circle.ByCenterPointRadius(Point.ByCoordinates(148.5, 81), 28)];
holes = [Circle.ByCenterPointRadius(Point.ByCoordinates(148.5, 130), 9),
         Circle.ByCenterPointRadius(Point.ByCoordinates(148.5, 80), 12)];
# ----------------------------------------
byCurves = Plotter.Shape.ByCurves(curves=code_block.outer)
union = Plotter.Shape.Union(shapes=byCurves)
byCurves_2 = Plotter.Shape.ByCurves(curves=code_block.holes)
list_create = List.Create(item0=union, item1=byCurves_2)
combine = Plotter.Shape.Combine(shapes=list_create)

# group: 2. Halo rings, clipped to the page
code_block_2 = CodeBlock()
# ---------- code_block_2.designscript (1 lines) ----------
8; // page margin (mm)
# ----------------------------------------
region = Plotter.Page.Region(margin=code_block_2)
code_block_3 = CodeBlock()
# ---------- code_block_3.designscript (2 lines) ----------
24; // ring count
4;  // first offset (mm)
# ----------------------------------------
ring_spacing = DoubleSlider(5.5, range=2..12 step 0.5)
rings = Plotter.Shape.Rings(shape=combine, count=code_block_3.out0, spacing=ring_spacing, firstOffset=code_block_3.out1)
code_block_4 = CodeBlock { true; }
clip = Plotter.Shape.Clip(shape=region, geometry=rings, keepInside=code_block_4)

# group: 3. Outline, fill, pens and AxiDraw SVG export
code_block_5 = CodeBlock { "pink outline"; "#ff6fae"; 0.6; 1; }
wobble = Plotter.Shape.Wobble(shape=combine)
byGeometry = Plotter.Layer.ByGeometry(name=code_block_5.out0, geometry=wobble, color=code_block_5.out1, strokeWidth=code_block_5.out2, penNumber=code_block_5.out3)
code_block_6 = CodeBlock { "light fill"; "#c7d2fe"; 0.3; 2; }
code_block_7 = CodeBlock()
# ---------- code_block_7.designscript (3 lines) ----------
1.6; // hatch spacing
65;  // hatch angle
1.5; // inset from outline
# ----------------------------------------
hatch = Plotter.Shape.Hatch(shape=combine, spacing=code_block_7.out0, angle=code_block_7.out1, inset=code_block_7.out2)
byGeometry_2 = Plotter.Layer.ByGeometry(name=code_block_6.out0, geometry=hatch, color=code_block_6.out1, strokeWidth=code_block_6.out2, penNumber=code_block_6.out3)
code_block_8 = CodeBlock { "blue rings"; "#1d4ed8"; 0.5; 3; }
byGeometry_3 = Plotter.Layer.ByGeometry(name=code_block_8.out0, geometry=clip, color=code_block_8.out1, strokeWidth=code_block_8.out2, penNumber=code_block_8.out3)
list_create_2 = List.Create(item0=byGeometry, item1=byGeometry_2, item2=byGeometry_3)
byLayers = Plotter.Drawing.ByLayers(layers=list_create_2)
optimize = Plotter.Drawing.Optimize(drawing=byLayers)
svg_file_path = StringInput("C:\Temp\PlotterNodes_eight.svg")
exportSvg = Plotter.Drawing.ExportSvg(drawing=optimize, filePath=svg_file_path)
statistics = Plotter.Drawing.Statistics(drawing=optimize)
watch = Watch(statistics.drawLength)
